# Dynamo graph 00_Vistas de assembly.dyn (Dynamo 4.0.2.3852)
# Por assembly: 1 planta NIPB + N plantas T.A. (agrupadas por altura real de las vigas) + 1 elevacion por cada eje que cruza el assembly. Escribe un nombre en "04. Subcarpeta" y se crea un tipo de vista con ese nombre para agrupar todo en el Project Browser. Idempotente: salta las vistas que ya existen (usa "Recrear" para rehacerlas).

n01_procesar_todos_los_assemblies = BoolSelector(true)  # "01. Procesar TODOS los assemblies"; graph input
n02_filtro_por_nombre_si_todos = StringInput("")  # "02. Filtro por nombre (si TODOS = False)"; graph input
n03_recrear_vistas_existentes = BoolSelector(false)  # "03. Recrear vistas existentes (borra y rehace)"; graph input
n08_offset_del_corte_nipb_sobre = IntegerSlider(100, range=0..500 step 10)  # "08. Offset del corte NIPB sobre la cara mas baja (cm)"; graph input
n09_tolerancia_de_agrupacion_t_a = IntegerSlider(100, range=10..500 step 10)  # "09. Tolerancia de agrupacion T.A. (cm)"; graph input
n10_offset_del_corte_t_a_sobre_el = IntegerSlider(100, range=0..500 step 10)  # "10. Offset del corte T.A. sobre el nivel dominante (cm)"; graph input
n05_tipo_de_vista_base_se_duplica = StringInput("02_ESTRUCTURAS")  # "05. Tipo de vista BASE (se duplica para la subcarpeta)"; graph input
n06_view_template_para_las_vistas = StringInput("ESTRUCTURA_1/75")  # "06. View template para las vistas (vacio = ninguno)"; graph input
n12_margen_del_crop_mm = IntegerSlider(30, range=5..100 step 5)  # "12. Margen del crop (mm)"; graph input
n07_escala_de_las_vistas_1_n = IntegerSlider(75, range=10..500 step 5)  # "07. Escala de las vistas (1:N)"; graph input
n13_far_clip_de_las_elevaciones = IntegerSlider(5500, range=500..30000 step 500)  # "13. Far Clip de las elevaciones (mm)"; graph input
n11_profundidad_de_las_plantas = IntegerSlider(100, range=10..1000 step 10)  # "11. Profundidad de las plantas bajo el nivel (cm)"; graph input
n04_subcarpeta_del_project = StringInput("")  # "04. Subcarpeta del Project Browser (vacio = usar el tipo base)"; graph input
py_nipb_plantas_t_a_elevaciones = Python(IN[0]=n01_procesar_todos_los_assemblies, IN[1]=n02_filtro_por_nombre_si_todos, IN[2]=n03_recrear_vistas_existentes, IN[3]=n08_offset_del_corte_nipb_sobre, IN[4]=n09_tolerancia_de_agrupacion_t_a, IN[5]=n10_offset_del_corte_t_a_sobre_el, IN[6]=n05_tipo_de_vista_base_se_duplica, IN[7]=n06_view_template_para_las_vistas, IN[8]=n12_margen_del_crop_mm, IN[9]=n07_escala_de_las_vistas_1_n, IN[10]=n13_far_clip_de_las_elevaciones, IN[11]=n11_profundidad_de_las_plantas, IN[12]=n04_subcarpeta_del_project)  # "PY | NIPB + plantas T.A. + elevaciones de eje"; PythonNet3
# ---------- py_nipb_plantas_t_a_elevaciones.python (1095 lines) ----------
# 00_Vistas de assembly - ACERO: planta NIPB + plantas T.A. (clustering geometrico)
# + una elevacion por cada eje que cruza el assembly.
# Revit 2027 / Dynamo 4 / CPython3
# IN[0] = procesar todos los assemblies (bool)
# IN[1] = filtro por nombre si IN[0] es False (parcial, separado por comas)
# IN[2] = recrear vistas existentes (bool) - borra y vuelve a crear
# IN[3] = offset del plano de corte NIPB sobre la cara mas baja del assembly (cm)
# IN[4] = tolerancia de agrupacion de vigas por altura T.A. (cm)
# IN[5] = offset del plano de corte T.A. sobre el nivel dominante del grupo (cm)
# IN[6] = tipo de vista (ViewFamilyType de Section) para las elevaciones de eje
# IN[7] = view template para todas las vistas (vacio = ninguno; si no existe, avisa)
# IN[8] = margen del crop sobre el borde del assembly, en mm de papel
# IN[9] = escala de todas las vistas (1:N) - plantas y elevaciones comparten escala
# IN[10] = Far Clip Offset (mm) de las ELEVACIONES de eje (las plantas usan IN[12])
# IN[6]  = nombre del tipo de vista, comun a plantas y elevaciones (ej. 02_ESTRUCTURAS)
# IN[11] = profundidad de las PLANTAS por debajo del nivel definido (cm)
# IN[12] = subcarpeta del Project Browser: se crea un TIPO DE VISTA con ese nombre
#          (duplicado del tipo base de IN[6]) y se asigna a todas las vistas, que es
#          lo que hace aparecer el nodo en el browser. Vacio = usar el tipo de IN[6].
#
# NOTA DE DISEÑO (2026-07-28): las plantas NO se crean con AssemblyViewUtils.
# Una vista de assembly limita lo que muestra a los MIEMBROS del assembly y por eso
# nunca dibuja datums: verificado en el modelo real, la planta de assembly devolvia
# 0 ejes mientras una ViewPlan normal del mismo sector devolvia 54. Sin ejes visibles
# tampoco se ven las cotas entre ejes de 03, porque sus referencias son los ejes.
# Por eso las plantas son ViewPlan normales, recortadas al assembly y AISLADAS a sus
# miembros + los ejes que lo cruzan - la misma tecnica que ya funcionaba en las
# elevaciones de eje.

import clr
clr.AddReference('RevitAPI')
clr.AddReference('RevitServices')
from Autodesk.Revit.DB import (FilteredElementCollector, AssemblyInstance,
                               View, UnitUtils, UnitTypeId, XYZ, Element,
                               BuiltInParameter, BuiltInCategory,
                               ElementId, ViewFamilyType, ViewFamily, StorageType,
                               BoundingBoxXYZ, ViewDetailLevel, Options, Solid,
                               GeometryInstance, FamilyInstance, ViewSection,
                               Grid, Line, Transform, ViewPlan, Level,
                               PlanViewPlane)
from RevitServices.Persistence import DocumentManager
from RevitServices.Transactions import TransactionManager
from System.Collections.Generic import List

doc = DocumentManager.Instance.CurrentDBDocument

process_all = bool(IN[0])
filter_text = (IN[1] or '').strip()
recreate = bool(IN[2])
off_nipb = float(IN[3]) / 30.48        # cm -> pies
tol_ta = float(IN[4]) / 30.48          # cm -> pies
off_ta = float(IN[5]) / 30.48          # cm -> pies
sec_type_text = (IN[6] or '').strip()
tpl_text = (IN[7] or '').strip()
crop_margin_mm = float(IN[8])
escala = int(IN[9]) if IN[9] else 75
far_clip = float(IN[10]) / 304.8 if IN[10] else 5500.0 / 304.8   # mm -> pies
# El MISMO nombre de tipo sirve para plantas y elevaciones: son ViewFamilyType
# distintos (Floor Plan vs Section) que en este proyecto se llaman igual
# ("02_ESTRUCTURAS"). Cada uno se resuelve dentro de su propia ViewFamily.
plan_type_text = sec_type_text
prof_planta = float(IN[11]) / 30.48 if IN[11] else 100.0 / 30.48   # cm -> pies
nombre_carpeta = (IN[12] or '').strip()

# Holgura del plano Top por encima del plano de corte. NO puede ser cero: un View
# Range con Top == Cut es degenerado y colapsa el espesor del CropBox, dejando la
# vista sin dibujar (Revit ni siquiera la puede abrir). 10 cm alcanzan para que el
# rango sea valido sin arrastrar el nivel de arriba a la planta.
HOLGURA_TOP = 10.0 / 30.48   # cm -> pies

log = []

# --- contrato de nombres (lo usan 01, 02, 03, 04, 06 y 07 para encontrar las vistas) ---
# El NOMBRE INTERNO de la vista es estable y correlativo; el TITULO EN LAMINA
# (Title on Sheet / VIEW_DESCRIPTION) es el legible y puede llevar la cota.
SUF_NIPB = ' - NIPB'
SUF_TA = ' - T.A. '        # + correlativo de 2 digitos, ascendente por altura
SUF_EJE = ' - EJE '        # + nombre del eje
TIT_NIPB = ' - PLANTA N.I.P.B.'
TIT_TA = ' - PLANTA T.A. (EL. {})'
TIT_EJE = ' - ELEVACION EJE {}'

# Categoria que define el "tope de acero": solo las vigas mandan en el clustering.
CAT_VIGAS = BuiltInCategory.OST_StructuralFraming
ID_CAT_VIGAS = ElementId(CAT_VIGAS).Value


def to_m(v):
    return UnitUtils.ConvertFromInternalUnits(v, UnitTypeId.Meters)


def fmt_cota(m):
    # formato chileno (punto de miles, coma decimal), igual que las vistas que ya
    # existen en el modelo: "PLANTA ESTRUCTURA EL. 2.305,25 T.A."
    s = '{:,.2f}'.format(m)
    return s.replace(',', '@').replace('.', ',').replace('@', '.')


def elem_name(e):
    try:
        return e.Name
    except Exception:
        return Element.Name.__get__(e)


def set_name(e, name):
    try:
        e.Name = name
    except Exception:
        Element.Name.__set__(e, name)


# --- tipo de vista para las elevaciones de eje (debe ser ViewFamily.Section) ---
sec_vft = None
tipos_section = [t for t in FilteredElementCollector(doc).OfClass(ViewFamilyType)
                 if t.ViewFamily == ViewFamily.Section]
if sec_type_text:
    low = sec_type_text.lower()
    for t in tipos_section:
        if elem_name(t).lower() == low:
            sec_vft = t
            break
    if sec_vft is None:
        log.append('AVISO: no existe el tipo de vista de seccion {}; se usa el primero disponible.'.format(sec_type_text))
        log.append('Tipos de Section en este proyecto: ' + ', '.join(sorted(elem_name(t) for t in tipos_section)))
if sec_vft is None:
    if tipos_section:
        sec_vft = sorted(tipos_section, key=lambda t: elem_name(t))[0]
    else:
        log.append('ERROR: no hay ningun ViewFamilyType de tipo Section en el proyecto; no se pueden crear elevaciones de eje.')

# --- tipo de vista para las plantas (StructuralPlan o FloorPlan) ---
plan_vft = None
FAMILIAS_PLAN = (ViewFamily.StructuralPlan, ViewFamily.FloorPlan)
tipos_plan = [t for t in FilteredElementCollector(doc).OfClass(ViewFamilyType)
              if t.ViewFamily in FAMILIAS_PLAN]
if plan_type_text:
    lowp = plan_type_text.lower()
    for t in tipos_plan:
        if elem_name(t).lower() == lowp:
            plan_vft = t
            break
    if plan_vft is None:
        log.append('AVISO: no existe el tipo de vista de planta {}; se usa el primero disponible.'.format(plan_type_text))
        log.append('Tipos de planta en este proyecto: ' + ', '.join(sorted(elem_name(t) for t in tipos_plan)))
if plan_vft is None:
    # se prefiere StructuralPlan sobre FloorPlan
    estructurales = [t for t in tipos_plan if t.ViewFamily == ViewFamily.StructuralPlan]
    fuente = estructurales if estructurales else tipos_plan
    if fuente:
        plan_vft = sorted(fuente, key=lambda t: elem_name(t))[0]
    else:
        log.append('ERROR: no hay ningun ViewFamilyType de planta (StructuralPlan/FloorPlan) en el proyecto.')


def tipo_carpeta(base_vft, familias, etiqueta):
    # "Subcarpeta del Project Browser" = un TIPO DE VISTA propio.
    #
    # El Project Browser agrupa las vistas por "Family and Type", asi que la forma
    # de conseguir un nodo propio SIN depender de que alguien configure a mano un
    # esquema de Browser Organization es crear un ViewFamilyType con ese nombre y
    # asignarselo a todas las vistas. Se duplica del tipo base (input 05) para
    # heredar su grafismo.
    #
    # OJO: la ViewFamily (Floor Plans / Sections) es un nivel de agrupacion POR
    # ENCIMA del tipo, asi que esto da DOS nodos con el mismo nombre -uno con las
    # plantas y otro con las elevaciones-, no una carpeta unica con todo. Una
    # carpeta unica que mezcle ambas solo se logra con un esquema de Browser
    # Organization que agrupe por un parametro compartido.
    #
    # Duplicate() necesita una transaccion abierta: se llama desde el bloque
    # principal, no aca arriba.
    if not nombre_carpeta or base_vft is None:
        return base_vft
    low = nombre_carpeta.lower()
    for t in FilteredElementCollector(doc).OfClass(ViewFamilyType):
        if t.ViewFamily in familias and elem_name(t).lower() == low:
            return t
    try:
        nuevo = base_vft.Duplicate(nombre_carpeta)
        log.append('Carpeta "{}": tipo de vista creado para {} (duplicado de "{}").'.format(
            nombre_carpeta, etiqueta, elem_name(base_vft)))
        return nuevo
    except Exception as e:
        log.append('ERROR creando el tipo de vista "{}" para {}: {}'.format(nombre_carpeta, etiqueta, e))
        return base_vft

# --- niveles, solo como ancla del View Range de las plantas ---
# El nivel NO define la cota de la planta (el criterio sigue siendo geometrico): se
# usa como origen de los offsets del View Range, que es lo unico que pide la API.
def elev_nivel(l):
    # SIEMPRE ProjectElevation, NUNCA Elevation.
    # Este modelo usa "Elevation Base = Shared": los niveles reportan la cota real
    # del sitio (~7546 pies = 2300 m, el salar) mientras la geometria vive cerca del
    # origen del proyecto (una columna medida da Z = 3,84 a 10,83 pies). Anclar el
    # View Range con Elevation mandaba el plano de corte ~7538 pies fuera del modelo:
    # las plantas salian VACIAS y, sin plano de corte que cruzara sus extensiones,
    # los ejes tampoco se dibujaban. ProjectElevation va siempre en coordenadas de
    # proyecto, el mismo sistema en el que se mide la geometria.
    try:
        return l.ProjectElevation
    except Exception:
        return l.Elevation


niveles = sorted(FilteredElementCollector(doc).OfClass(Level), key=elev_nivel)
if not niveles:
    log.append('ERROR: el proyecto no tiene ningun Level; ViewPlan.Create no puede crear plantas.')
else:
    try:
        _l0 = niveles[0]
        if abs(_l0.Elevation - _l0.ProjectElevation) > 0.01:
            log.append('NOTA: el modelo usa cota compartida (nivel {}: Elevation {} m vs ProjectElevation {} m).'.format(
                elem_name(_l0), fmt_cota(to_m(_l0.Elevation)), fmt_cota(to_m(_l0.ProjectElevation))))
            log.append('      El View Range se ancla con ProjectElevation, que es el sistema de la geometria.')
    except Exception:
        pass


def nivel_ancla(z):
    return min(niveles, key=lambda l: abs(elev_nivel(l) - z))

# --- view template unico para todas las vistas ---
templates = [t for t in FilteredElementCollector(doc).OfClass(View) if t.IsTemplate]
view_template = None
if not tpl_text:
    log.append('Sin view template (campo vacio). Templates cargados en el proyecto:')
    for t in sorted(templates, key=lambda t: elem_name(t)):
        log.append('  - ' + elem_name(t))
    if not templates:
        log.append('  (ninguno cargado en este proyecto)')
else:
    lowt = tpl_text.lower()
    for t in templates:
        if elem_name(t).lower() == lowt:
            view_template = t
            break
    if view_template is None:
        cands = [t for t in templates if lowt in elem_name(t).lower()]
        if len(cands) == 1:
            view_template = cands[0]
    if view_template is None:
        log.append('AVISO: no existe un view template que coincida con {}; las vistas quedan sin template.'.format(tpl_text))
        log.append('Templates cargados en el proyecto: ' + ', '.join(sorted(elem_name(t) for t in templates)))

# --- assemblies unicos por tipo ---
by_type = {}
for ai in FilteredElementCollector(doc).OfClass(AssemblyInstance):
    by_type.setdefault(ai.AssemblyTypeName, []).append(ai)

if not by_type:
    log.append('AVISO: no hay ningun Assembly en el modelo. Todo este pipeline es assembly-driven:')
    log.append('  crea los assemblies en Revit (Modificar > Crear ensamblaje) y vuelve a correr.')

if process_all:
    targets = sorted(by_type.keys())
else:
    tokens = [t.strip().lower() for t in filter_text.split(',') if t.strip()]
    if tokens:
        targets = [n for n in sorted(by_type.keys())
                   if any(tok in n.lower() for tok in tokens)]
    else:
        targets = []
        log.append('ERROR: "Procesar todos" esta en False y el filtro esta vacio.')
    log.append('Filtro "{}": {} assemblies seleccionados.'.format(filter_text, len(targets)))

# vistas existentes por nombre (para idempotencia)
view_ids = {}
for v in FilteredElementCollector(doc).OfClass(View):
    if not v.IsTemplate:
        view_ids[elem_name(v)] = v.Id


def member_solid_bbox(el):
    # bounding box de el a partir de su geometria SOLIDA real (Volume > 0), en vez
    # de Element.get_BoundingBox() - que puede devolver un bbox "fantasma" (de
    # referencias/work planes) para elementos con geometria vacia o degenerada.
    # Devuelve None si el elemento no tiene ningun solido valido, asi el llamador
    # puede excluirlo del calculo en vez de heredar un tamaño inventado.
    opt = Options()
    opt.DetailLevel = ViewDetailLevel.Fine
    try:
        geo = el.get_Geometry(opt)
    except Exception:
        geo = None
    if geo is None:
        return None
    minx = miny = minz = float('inf')
    maxx = maxy = maxz = float('-inf')
    hay = False

    def puntos(solid, trf):
        sbb = solid.GetBoundingBox()
        for x in (sbb.Min.X, sbb.Max.X):
            for y in (sbb.Min.Y, sbb.Max.Y):
                for z in (sbb.Min.Z, sbb.Max.Z):
                    p = sbb.Transform.OfPoint(XYZ(x, y, z))
                    if trf is not None:
                        p = trf.OfPoint(p)
                    yield p

    pts = []
    for g in geo:
        if isinstance(g, Solid) and g.Volume > 1e-9:
            pts.extend(list(puntos(g, None)))
        elif isinstance(g, GeometryInstance):
            for sg in g.GetSymbolGeometry():
                if isinstance(sg, Solid) and sg.Volume > 1e-9:
                    pts.extend(list(puntos(sg, g.Transform)))
    for p in pts:
        hay = True
        if p.X < minx: minx = p.X
        if p.X > maxx: maxx = p.X
        if p.Y < miny: miny = p.Y
        if p.Y > maxy: maxy = p.Y
        if p.Z < minz: minz = p.Z
        if p.Z > maxz: maxz = p.Z
    if not hay:
        return None

    class _BB(object):
        pass
    r = _BB()
    r.Min = XYZ(minx, miny, minz)
    r.Max = XYZ(maxx, maxy, maxz)
    return r


def instancias_recursivas(ai):
    # TODAS las FamilyInstance del assembly (contenedores y hojas, cualquier
    # profundidad de anidamiento).
    vistos = set()
    resultado = []
    stack = list(ai.GetMemberIds())
    while stack:
        eid = stack.pop()
        if eid.Value in vistos:
            continue
        vistos.add(eid.Value)
        el = doc.GetElement(eid)
        if el is None or not isinstance(el, FamilyInstance):
            continue
        resultado.append(el)
        try:
            stack.extend(list(el.GetSubComponentIds()))
        except Exception:
            pass
    return resultado


def ids_recursivos(ai):
    # TODOS los ElementId del assembly (cualquier clase, cualquier profundidad).
    # Se usa para aislar el assembly en las elevaciones de eje, que son secciones
    # normales del modelo (no vistas de assembly) y por defecto muestran todo.
    vistos = set()
    resultado = []
    stack = list(ai.GetMemberIds())
    while stack:
        eid = stack.pop()
        if eid.Value in vistos:
            continue
        vistos.add(eid.Value)
        resultado.append(eid)
        el = doc.GetElement(eid)
        if isinstance(el, FamilyInstance):
            try:
                stack.extend(list(el.GetSubComponentIds()))
            except Exception:
                pass
    return resultado


def bbox_con_anidados(el):
    # bbox solido de el INCLUYENDO sus sub-componentes anidados (recursivo). Los
    # contenedores (familias cuya geometria real vive en anidadas mas profundas)
    # devuelven None con member_solid_bbox a secas.
    pila = [el]
    vistos = set()
    minx = miny = minz = float('inf')
    maxx = maxy = maxz = float('-inf')
    hay = False
    while pila:
        e = pila.pop()
        if e is None:
            continue
        try:
            eid = e.Id.Value
        except Exception:
            eid = None
        if eid is not None:
            if eid in vistos:
                continue
            vistos.add(eid)
        bb = member_solid_bbox(e)
        if bb is not None:
            hay = True
            if bb.Min.X < minx: minx = bb.Min.X
            if bb.Max.X > maxx: maxx = bb.Max.X
            if bb.Min.Y < miny: miny = bb.Min.Y
            if bb.Max.Y > maxy: maxy = bb.Max.Y
            if bb.Min.Z < minz: minz = bb.Min.Z
            if bb.Max.Z > maxz: maxz = bb.Max.Z
        if isinstance(e, FamilyInstance):
            try:
                for sid in e.GetSubComponentIds():
                    pila.append(doc.GetElement(sid))
            except Exception:
                pass
    if not hay:
        return None

    class _BB(object):
        pass
    r = _BB()
    r.Min = XYZ(minx, miny, minz)
    r.Max = XYZ(maxx, maxy, maxz)
    return r


def bbox_assembly(ai):
    # bbox de MUNDO del assembly completo, medido sobre geometria solida real.
    minx = miny = minz = float('inf')
    maxx = maxy = maxz = float('-inf')
    hay = False
    for mid in ai.GetMemberIds():
        el = doc.GetElement(mid)
        bb = bbox_con_anidados(el) if el is not None else None
        if bb is None:
            continue
        hay = True
        if bb.Min.X < minx: minx = bb.Min.X
        if bb.Max.X > maxx: maxx = bb.Max.X
        if bb.Min.Y < miny: miny = bb.Min.Y
        if bb.Max.Y > maxy: maxy = bb.Max.Y
        if bb.Min.Z < minz: minz = bb.Min.Z
        if bb.Max.Z > maxz: maxz = bb.Max.Z
    if not hay:
        return None

    class _BB(object):
        pass
    r = _BB()
    r.Min = XYZ(minx, miny, minz)
    r.Max = XYZ(maxx, maxy, maxz)
    return r


# ---------------------------------------------------------------- clustering T.A.

def tops_de_vigas(ai):
    # elevacion Z de la CARA SUPERIOR de cada viga del assembly (recursivo).
    # Se mide sobre geometria solida real, no sobre el Level nativo: los niveles
    # que crean los modeladores no son fiables (nomenclatura inconsistente y
    # varios a menos de 1 m entre si).
    tops = []
    for el in instancias_recursivas(ai):
        try:
            cat = el.Category
            if cat is None or cat.Id.Value != ID_CAT_VIGAS:
                continue
        except Exception:
            continue
        bb = bbox_con_anidados(el)
        if bb is None:
            continue
        tops.append(bb.Max.Z)
    return sorted(tops)


def agrupar_por_altura(tops, tol):
    # Agrupamiento por cercania con AMPLITUD ACOTADA: se recorre en orden
    # ascendente y se abre un grupo nuevo cuando la viga se aleja mas de "tol"
    # del INICIO del grupo actual (no de la viga anterior). Encadenar por la
    # viga anterior permitiria que una escalera de vigas separadas 0.9 m cada
    # una terminara en un solo grupo de decenas de metros; asi cada grupo mide
    # como maximo "tol" de amplitud, que es lo que pide el criterio de +-1 m.
    grupos = []
    if not tops:
        return grupos
    actual = [tops[0]]
    z0 = tops[0]
    for z in tops[1:]:
        if z - z0 <= tol:
            actual.append(z)
        else:
            grupos.append(actual)
            actual = [z]
            z0 = z
    grupos.append(actual)
    return grupos


def z_dominante(grupo):
    # nivel dominante del grupo = la elevacion con MAS vigas (moda), agrupando
    # en cubetas de 5 mm para que valores casi identicos cuenten juntos.
    # Empate -> gana la cubeta mas alta (el T.A. real suele ser la cara mas alta).
    conteo = {}
    for z in grupo:
        k = int(round(z * 304.8 / 5.0))
        conteo.setdefault(k, []).append(z)
    mejor_k = None
    mejor = None
    for k, zs in conteo.items():
        clave = (len(zs), k)
        if mejor is None or clave > mejor:
            mejor = clave
            mejor_k = k
    zs = conteo[mejor_k]
    return sum(zs) / float(len(zs))


# ---------------------------------------------------------------- ejes / grids

def segmento_cruza_rect(p0, p1, xmin, ymin, xmax, ymax):
    # recorte Liang-Barsky del SEGMENTO (no la recta infinita) contra el
    # rectangulo en planta: "el eje cruza el assembly" significa que el eje tal
    # como esta dibujado pasa por la huella del assembly.
    dx = p1.X - p0.X
    dy = p1.Y - p0.Y
    t0 = 0.0
    t1 = 1.0
    for pc, q in ((-dx, p0.X - xmin), (dx, xmax - p0.X),
                  (-dy, p0.Y - ymin), (dy, ymax - p0.Y)):
        if abs(pc) < 1e-12:
            if q < 0:
                return False
        else:
            r = q / pc
            if pc < 0:
                if r > t1:
                    return False
                if r > t0:
                    t0 = r
            else:
                if r < t0:
                    return False
                if r < t1:
                    t1 = r
    return True


def ejes_que_cruzan(bb, tname):
    # ejes cuya linea atraviesa la huella en planta del assembly
    res = []
    for g in FilteredElementCollector(doc).OfClass(Grid):
        try:
            c = g.Curve
        except Exception:
            continue
        if c is None:
            continue
        if not isinstance(c, Line):
            log.append('AVISO {}: el eje {} no es una linea recta; se omite su elevacion.'.format(tname, elem_name(g)))
            continue
        p0 = c.GetEndPoint(0)
        p1 = c.GetEndPoint(1)
        if segmento_cruza_rect(p0, p1, bb.Min.X, bb.Min.Y, bb.Max.X, bb.Max.Y):
            res.append(g)
    res.sort(key=lambda g: elem_name(g))
    return res


# ---------------------------------------------------------------- ajustes de vista

_viewers = None


def find_viewer(vname):
    # marcador de la vista (categoria Views/Viewers), comparte nombre con la vista
    global _viewers
    if _viewers is None:
        _viewers = {}
        for ve in FilteredElementCollector(doc).OfCategory(BuiltInCategory.OST_Viewers):
            _viewers[elem_name(ve)] = ve
    v = _viewers.get(vname)
    if v is not None:
        return v
    # puede ser una vista recien creada en esta corrida: refrescar el indice
    _viewers = {}
    for ve in FilteredElementCollector(doc).OfCategory(BuiltInCategory.OST_Viewers):
        _viewers[elem_name(ve)] = ve
    return _viewers.get(vname)


def aplicar_far_clip(v, tname, label):
    # Far Clip Offset fijo (input), igual para plantas y elevaciones. Si el modo de
    # recorte lejano esta en "sin recorte" (0), el offset no haria nada, asi que se
    # activa: 0 = No clip, 1 = Clip without line, 2 = Clip with line.
    try:
        pa = v.get_Parameter(BuiltInParameter.VIEWER_BOUND_ACTIVE_FAR)
        if pa is not None and not pa.IsReadOnly and pa.AsInteger() == 0:
            pa.Set(1)
    except Exception:
        pass
    try:
        p = v.get_Parameter(BuiltInParameter.VIEWER_BOUND_OFFSET_FAR)
        if p is not None and not p.IsReadOnly:
            p.Set(far_clip)
    except Exception as e:
        log.append('AVISO {}: no se pudo fijar el Far Clip de {}: {}'.format(tname, label, e))


def fijar_view_range(vplan, z_corte, z_fondo, level, tname, label):
    # En una ViewPlan la profundidad no la controla el Far Clip Offset sino el
    # View Range. Todos los planos se anclan al MISMO nivel y se expresan como
    # offset respecto a su elevacion, asi que el nivel elegido es indiferente
    # (solo es el origen de coordenadas del rango).
    #   Top    = Cut + HOLGURA_TOP
    #   Bottom = View Depth = z_fondo
    # El fondo se mide desde el NIVEL DEFINIDO (la cara mas baja en la NIPB, el
    # nivel dominante en las T.A.), no desde el plano de corte: el corte va un
    # offset por encima del nivel y no tiene por que arrastrar la profundidad.
    # El Far Clip Offset del input NO se usa aca; es solo para las elevaciones.
    #
    # ORDEN ESTRICTO (2026-07-28): Revit exige Top >= Cut >= Bottom >= ViewDepth.
    # Antes se ponia Top = Cut y eso rompia la vista entera: con el rango de altura
    # colapsado a cero, el CropBox que ajustar_crop_a_assembly() lee justo despues
    # hereda un espesor nulo (Min.Z == Max.Z) y el BoundingBoxXYZ queda degenerado.
    # Sintoma: la planta no dibuja NADA y Revit ni siquiera puede abrirla, aunque
    # FilteredElementCollector(doc, view.Id) siga contando elementos visibles.
    e = elev_nivel(level)
    corte = z_corte - e
    fondo = z_fondo - e
    if fondo > corte - HOLGURA_TOP:
        # el fondo quedo por encima (o pegado) al corte: se fuerza un rango sano
        log.append('AVISO {}: el fondo de {} quedaba sobre el plano de corte; se baja a {:.2f} m bajo el corte.'.format(
            tname, label, to_m(prof_planta)))
        fondo = corte - max(prof_planta, HOLGURA_TOP)
    top = corte + HOLGURA_TOP
    try:
        vr = vplan.GetViewRange()
        for plano, off in ((PlanViewPlane.TopClipPlane, top),
                           (PlanViewPlane.CutPlane, corte),
                           (PlanViewPlane.BottomClipPlane, fondo),
                           (PlanViewPlane.ViewDepthPlane, fondo)):
            vr.SetLevelId(plano, level.Id)
            vr.SetOffset(plano, off)
        vplan.SetViewRange(vr)
        log.append('{}: {} cortada en EL. {}, fondo en EL. {} ({:.2f} m de profundidad, top +{:.2f} m).'.format(
            tname, label, fmt_cota(to_m(z_corte)), fmt_cota(to_m(z_fondo)),
            to_m(z_corte - z_fondo), to_m(HOLGURA_TOP)))
    except Exception as ex:
        log.append('ERROR {}: no se pudo fijar el View Range de {}: {}'.format(tname, label, ex))


def ajustar_crop_a_assembly(v, ai, tname, label):
    # recorta el crop (ancho y alto, en los ejes propios de la vista) al borde
    # del assembly + margen de papel. El Annotation Crop se desactiva para que
    # cotas/tags/leaders, que viven por fuera del borde, no queden cortados.
    bb = v.CropBox
    inv = bb.Transform.Inverse
    minx = miny = float('inf')
    maxx = maxy = float('-inf')
    hay_geo = False
    for mid in ai.GetMemberIds():
        el = doc.GetElement(mid)
        mbb = bbox_con_anidados(el) if el is not None else None
        if mbb is None:
            continue
        hay_geo = True
        for x in (mbb.Min.X, mbb.Max.X):
            for y in (mbb.Min.Y, mbb.Max.Y):
                for z in (mbb.Min.Z, mbb.Max.Z):
                    p = inv.OfPoint(XYZ(x, y, z))
                    if p.X < minx: minx = p.X
                    if p.X > maxx: maxx = p.X
                    if p.Y < miny: miny = p.Y
                    if p.Y > maxy: maxy = p.Y
    if not hay_geo:
        log.append('AVISO {}: sin geometria para ajustar el crop de {}.'.format(tname, label))
        return
    margen = crop_margin_mm / 304.8 * (v.Scale if v.Scale > 0 else 1)
    # El espesor en Z se hereda del crop actual, pero NUNCA puede quedar en cero:
    # un BoundingBoxXYZ degenerado deja la vista sin dibujar. En una planta el Z del
    # crop lo deriva Revit del View Range, asi que si el rango venia colapsado esto
    # es la ultima linea de defensa (ver nota en fijar_view_range).
    zmin_c = bb.Min.Z
    zmax_c = bb.Max.Z
    if zmax_c - zmin_c < 1e-6:
        zmin_c = zmin_c - 1.0
        zmax_c = zmax_c + 1.0
        log.append('AVISO {}: el crop de {} venia con espesor cero; se le dio 2 m.'.format(tname, label))
    nuevo = BoundingBoxXYZ()
    nuevo.Transform = bb.Transform
    nuevo.Min = XYZ(minx - margen, miny - margen, zmin_c)
    nuevo.Max = XYZ(maxx + margen, maxy + margen, zmax_c)
    v.CropBox = nuevo
    try:
        mgr = v.GetCropRegionShapeManager()
        mgr.IsAnnotationCropActive = False
    except Exception:
        pass
    log.append('   crop de {}: {:.2f} x {:.2f} m.'.format(
        label, to_m(maxx - minx + 2 * margen), to_m(maxy - miny + 2 * margen)))


def preparar_vista(v, tname, label):
    # ajustes comunes a toda vista creada por este graph
    # El tipo de vista es lo que define la carpeta del Project Browser, y se
    # reaplica tambien a las vistas que YA existian: asi cambiar el nombre de la
    # carpeta no obliga a recrearlas. Va primero, porque cambiar el tipo puede
    # arrastrar propiedades que los ajustes de mas abajo vuelven a fijar.
    try:
        objetivo = plan_vft if isinstance(v, ViewPlan) else sec_vft
        if objetivo is not None and v.GetTypeId() != objetivo.Id:
            v.ChangeTypeId(objetivo.Id)
    except Exception as e:
        log.append('AVISO {}: no se pudo cambiar el tipo de vista de {}: {}'.format(tname, label, e))
    try:
        v.Scale = escala
    except Exception:
        pass
    try:
        v.DetailLevel = ViewDetailLevel.Fine
    except Exception:
        pass
    try:
        # "Crop View" (recorte de geometria) activo, pero SIN dibujar el rectangulo:
        # sin el recorte la vista ocupa su extension completa y 01/02 calculan
        # bloques mucho mas grandes de lo real.
        if not v.CropBoxActive:
            v.CropBoxActive = True
        if v.CropBoxVisible:
            v.CropBoxVisible = False
    except Exception as e:
        log.append('ERROR {} activando Crop View en {}: {}'.format(tname, label, e))
    if view_template is not None:
        try:
            if v.ViewTemplateId != view_template.Id:
                v.ViewTemplateId = view_template.Id
            # la escala la manda el input, no el template
            if v.Scale != escala:
                v.Scale = escala
        except Exception as e:
            log.append('ERROR {} aplicando template a {}: {}'.format(tname, label, e))
    # Far Clip despues del template: si el template trae su propio valor, gana el input.
    # Se aplica a TODA vista que crea este graph - plantas y elevaciones por igual.
    aplicar_far_clip(v, tname, label)



def set_titulo(v, texto):
    # titulo mostrado en lamina (Title on Sheet), sin tocar el nombre interno
    p = v.get_Parameter(BuiltInParameter.VIEW_DESCRIPTION)
    if p is None or p.IsReadOnly:
        return
    if p.AsString() != texto:
        p.Set(texto)


def ocultar_simbolos_corte(v):
    # las elevaciones salen limpias: sin las lineas de seccion de las otras
    # elevaciones del mismo assembly cruzandolas
    try:
        cat = ElementId(BuiltInCategory.OST_Sections)
        if v.CanCategoryBeHidden(cat):
            v.SetCategoryHidden(cat, True)
    except Exception:
        pass


PARAM_CANTIDAD = 'Cantidad_Inserto'
_param_avisado = [False]


def set_cantidad(v, cantidad, tname):
    p = v.LookupParameter(PARAM_CANTIDAD)
    if p is None:
        if not _param_avisado[0]:
            _param_avisado[0] = True
            log.append('AVISO: las vistas no tienen el parametro {} (agregarlo como parametro de proyecto en la categoria Views).'.format(PARAM_CANTIDAD))
        return
    if p.IsReadOnly:
        return
    st = p.StorageType
    if st == StorageType.Integer:
        p.Set(int(cantidad))
    elif st == StorageType.Double:
        p.Set(float(cantidad))
    else:
        p.Set(str(cantidad))


# ---------------------------------------------------------------- creacion

def borrar_si_toca(vname, tname, label):
    # devuelve la vista existente si hay que conservarla, None si hay que crearla
    if vname not in view_ids:
        return None, False
    if recreate:
        doc.Delete(view_ids[vname])
        del view_ids[vname]
        log.append('{}: {} anterior eliminada (tambien su viewport si estaba en un sheet).'.format(tname, label))
        return None, False
    return doc.GetElement(view_ids[vname]), True


def limpiar_sobrantes(tname):
    # con "recrear" activo se borran TODAS las T.A. y elevaciones previas del
    # assembly, no solo las que esta corrida va a volver a crear: el clustering
    # puede devolver menos grupos que antes (o cruzar menos ejes) y las vistas
    # sobrantes quedarian huerfanas con un nombre correlativo que ya no aplica.
    pref_ta = tname + SUF_TA
    pref_eje = tname + SUF_EJE
    for vname in list(view_ids.keys()):
        if vname.startswith(pref_ta) or vname.startswith(pref_eje):
            try:
                doc.Delete(view_ids[vname])
                del view_ids[vname]
            except Exception:
                pass


def nueva_planta(vname, level):
    # ViewPlan normal (no vista de assembly): es la unica forma de que los ejes se
    # dibujen y de que 03 pueda acotarlos. El recorte al assembly lo hace el
    # CropBox y el filtrado por assembly lo hace aislar_assembly().
    if plan_vft is None or not niveles:
        return None
    v = ViewPlan.Create(doc, plan_vft.Id, level.Id)
    set_name(v, vname)
    return v


def crear_elevacion_eje(ai, g, bb, tname):
    # Seccion real del modelo alineada con el eje. No es una vista de assembly
    # (AssemblyViewUtils solo ofrece orientaciones fijas: HorizontalDetail y
    # DetailSection A-D, que no sirven para "una elevacion por cada eje"), asi
    # que el aislamiento del assembly se hace explicito mas abajo.
    gname = elem_name(g)
    vname = tname + SUF_EJE + gname
    existente, saltar = borrar_si_toca(vname, tname, 'elevacion del eje ' + gname)
    if saltar:
        return existente, True
    if sec_vft is None:
        return None, False

    c = g.Curve
    d = c.GetEndPoint(1) - c.GetEndPoint(0)
    d = XYZ(d.X, d.Y, 0.0)
    if d.GetLength() < 1e-9:
        log.append('AVISO {}: el eje {} es degenerado en planta; se omite.'.format(tname, gname))
        return None, False
    d = d.Normalize()
    up = XYZ.BasisZ
    n = d.CrossProduct(up).Normalize()   # horizontal, perpendicular al eje
    origen = XYZ(c.GetEndPoint(0).X, c.GetEndPoint(0).Y, 0.0)

    # extension del assembly en el sistema local de la elevacion
    lxmin = lymin = lzmin = float('inf')
    lxmax = lymax = lzmax = float('-inf')
    for mid in ai.GetMemberIds():
        el = doc.GetElement(mid)
        mbb = bbox_con_anidados(el) if el is not None else None
        if mbb is None:
            continue
        for x in (mbb.Min.X, mbb.Max.X):
            for y in (mbb.Min.Y, mbb.Max.Y):
                for z in (mbb.Min.Z, mbb.Max.Z):
                    p = XYZ(x, y, z)
                    rel = p - origen
                    lx = rel.DotProduct(d)
                    ly = p.Z
                    lz = rel.DotProduct(n)
                    if lx < lxmin: lxmin = lx
                    if lx > lxmax: lxmax = lx
                    if ly < lymin: lymin = ly
                    if ly > lymax: lymax = ly
                    if lz < lzmin: lzmin = lz
                    if lz > lzmax: lzmax = lz
    if lxmin == float('inf'):
        log.append('AVISO {}: sin geometria para la elevacion del eje {}.'.format(tname, gname))
        return None, False

    m = crop_margin_mm / 304.8 * escala
    t = Transform.Identity
    t.BasisX = d          # a lo largo del eje = horizontal en la vista
    t.BasisY = up         # vertical en la vista
    t.BasisZ = n          # hacia el observador (BasisX x BasisY = n, sistema derecho)
    t.Origin = origen
    caja = BoundingBoxXYZ()
    caja.Transform = t
    caja.Min = XYZ(lxmin - m, lymin - m, lzmin - m)
    caja.Max = XYZ(lxmax + m, lymax + m, lzmax + m)

    v = ViewSection.CreateSection(doc, sec_vft.Id, caja)
    set_name(v, vname)
    view_ids[vname] = v.Id
    return v, False


def aislar_assembly(v, ai, grids, tname, label, extra=None):
    # La elevacion es una seccion normal: por defecto muestra TODO el modelo
    # dentro de la caja. Se aisla el assembly y se convierte el aislamiento
    # temporal en permanente, que es lo unico que sobrevive al cierre de la vista.
    # Se incluyen TODOS los ejes que cruzan el assembly, no solo el propio: 03
    # enciende la categoria Grids en estas vistas y los ejes transversales deben
    # poder verse; un eje que no entre en este aislamiento queda oculto para
    # siempre y 03 no puede recuperarlo encendiendo la categoria.
    ids = List[ElementId]()
    for eid in ids_recursivos(ai):
        ids.Add(eid)
    for g in (grids or []):
        if g is not None:
            ids.Add(g.Id)
    for eid in (extra or []):
        ids.Add(eid)
    if ids.Count == 0:
        log.append('AVISO {}: {} sin miembros que aislar.'.format(tname, label))
        return
    try:
        v.IsolateElementsTemporary(ids)
        doc.Regenerate()
        v.ConvertTemporaryHideIsolateToPermanent()
    except Exception as e:
        log.append('ERROR {} aislando el assembly en {}: {}'.format(tname, label, e))


# ---------------------------------------------------------------- main

plantas_creadas = 0
elevs_creadas = 0
saltadas = 0
resumen = []

TransactionManager.Instance.EnsureInTransaction(doc)
try:
    # La subcarpeta del Project Browser se materializa como un tipo de vista propio
    # (ver tipo_carpeta). Tiene que resolverse DENTRO de la transaccion porque
    # duplica un ViewFamilyType, y antes del bucle para que todas las vistas de esta
    # corrida nazcan ya con el tipo correcto.
    if nombre_carpeta:
        plan_vft = tipo_carpeta(plan_vft, FAMILIAS_PLAN, 'las plantas')
        sec_vft = tipo_carpeta(sec_vft, (ViewFamily.Section,), 'las elevaciones')
        # Regenerate obligatorio: sin esto, las vistas creadas en ESTA MISMA corrida
        # (ViewPlan.Create / ViewSection.CreateSection con el Id del tipo recien
        # duplicado) nacian con el tipo BASE en vez del nuevo -Revit no deja el tipo
        # recien duplicado listo para usarse en otras creaciones de la misma
        # transaccion hasta que se regenera-. Verificado 2026-07-29: sin esta linea
        # habia que correr el graph dos veces (la 2da corrida ya encontraba el tipo
        # existente por nombre y preparar_vista lo reasignaba).
        doc.Regenerate()

    for tname in targets:
        insts = by_type[tname]
        ai = insts[0]
        if len(insts) > 1:
            log.append('AVISO {}: {} instancias del mismo tipo, se documenta la primera.'.format(tname, len(insts)))
        try:
            bb = bbox_assembly(ai)
            if bb is None:
                log.append('ERROR {}: sin geometria solida valida en ningun miembro; se omite el assembly.'.format(tname))
                continue
            zmin = bb.Min.Z
            zmax = bb.Max.Z

            if recreate:
                limpiar_sobrantes(tname)

            # los ejes se resuelven ANTES que las vistas: las plantas se aislan a
            # los miembros del assembly MAS estos ejes, y sin ellos en la lista de
            # aislamiento no habria forma de que se dibujen.
            ejes = ejes_que_cruzan(bb, tname)
            if not ejes:
                log.append('AVISO {}: ningun eje cruza la huella del assembly.'.format(tname))
            else:
                log.append('{}: {} eje(s) cruzan el assembly -> {}'.format(
                    tname, len(ejes), ', '.join(elem_name(g) for g in ejes)))

            plantas = []   # (vista, etiqueta) para aislar al final

            # ---------- 1. planta NIPB (una por assembly) ----------
            vname = tname + SUF_NIPB
            z_nipb = zmin + off_nipb
            vnipb, saltar = borrar_si_toca(vname, tname, 'planta NIPB')
            if saltar:
                saltadas += 1
            else:
                vnipb = nueva_planta(vname, nivel_ancla(z_nipb))
                if vnipb is None:
                    log.append('ERROR {}: no se pudo crear la planta NIPB.'.format(tname))
                    continue
                view_ids[vname] = vnipb.Id
                plantas_creadas += 1
                log.append('OK {}: planta NIPB creada, escala 1:{}.'.format(tname, escala))
            if vnipb is not None:
                preparar_vista(vnipb, tname, 'planta NIPB')
                # corte a +off_nipb sobre la cara mas baja de TODO el assembly,
                # sea placa base, pletina o lo que resulte ser el punto mas bajo
                # el fondo se mide bajo la CARA MAS BAJA (zmin), no bajo el corte
                fijar_view_range(vnipb, z_nipb, zmin - prof_planta,
                                 nivel_ancla(z_nipb), tname, 'planta NIPB')
                ajustar_crop_a_assembly(vnipb, ai, tname, 'planta NIPB')
                set_titulo(vnipb, tname + TIT_NIPB)
                set_cantidad(vnipb, len(insts), tname)
                plantas.append((vnipb, 'planta NIPB'))

            # ---------- 2. plantas T.A. (clustering geometrico de vigas) ----------
            tops = tops_de_vigas(ai)
            if not tops:
                log.append('AVISO {}: no hay vigas (Structural Framing) con geometria; no se generan plantas T.A.'.format(tname))
                grupos = []
            else:
                grupos = agrupar_por_altura(tops, tol_ta)
                log.append('{}: {} vigas -> {} nivel(es) T.A. (tolerancia {:.2f} m).'.format(
                    tname, len(tops), len(grupos), to_m(tol_ta)))

            n_ta = 0
            for gi, grupo in enumerate(grupos):
                n_ta += 1
                zdom = z_dominante(grupo)
                vname = '{}{}{:02d}'.format(tname, SUF_TA, n_ta)
                vta, saltar = borrar_si_toca(vname, tname, 'planta T.A. {:02d}'.format(n_ta))
                if saltar:
                    saltadas += 1
                else:
                    vta = nueva_planta(vname, nivel_ancla(zdom + off_ta))
                    if vta is None:
                        log.append('ERROR {}: no se pudo crear la planta T.A. {:02d}.'.format(tname, n_ta))
                        continue
                    view_ids[vname] = vta.Id
                    plantas_creadas += 1
                if vta is not None:
                    etiqueta_ta = 'planta T.A. {:02d}'.format(n_ta)
                    preparar_vista(vta, tname, etiqueta_ta)
                    # el plano de corte va OFF_TA por encima del nivel dominante
                    # para capturar las vigas desfasadas dentro del rango, y el
                    # fondo baja PROF_PLANTA por debajo de ese mismo nivel
                    # dominante: la planta muestra su nivel y nada mas.
                    fijar_view_range(vta, zdom + off_ta, zdom - prof_planta,
                                     nivel_ancla(zdom + off_ta), tname, etiqueta_ta)
                    ajustar_crop_a_assembly(vta, ai, tname, etiqueta_ta)
                    set_titulo(vta, tname + TIT_TA.format(fmt_cota(to_m(zdom))))
                    plantas.append((vta, etiqueta_ta))
                    log.append('   T.A. {:02d}: {} viga(s), dominante EL. {}, amplitud {:.2f} m.'.format(
                        n_ta, len(grupo), fmt_cota(to_m(zdom)), to_m(max(grupo) - min(grupo))))

            # ---------- 3. elevaciones de eje ----------
            for g in ejes:
                gname = elem_name(g)
                label = 'elevacion del eje ' + gname
                try:
                    velev, saltar = crear_elevacion_eje(ai, g, bb, tname)
                    if velev is None:
                        continue
                    # Una elevacion ya existente NO se salta entera: se le vuelven a
                    # aplicar escala, template, far clip, aislamiento y titulo. Antes
                    # se hacia "continue" y las vistas creadas por corridas viejas
                    # quedaban congeladas con los defaults de entonces (visto el
                    # 2026-07-28: elevaciones con template ESTRUCTURAS_1/50, escala
                    # 1:100 y far clip 8550 mm mucho despues de cambiar los defaults).
                    if saltar:
                        saltadas += 1
                    else:
                        elevs_creadas += 1
                    preparar_vista(velev, tname, label)
                    aislar_assembly(velev, ai, ejes, tname, label)
                    ocultar_simbolos_corte(velev)
                    try:
                        mgr = velev.GetCropRegionShapeManager()
                        mgr.IsAnnotationCropActive = False
                    except Exception:
                        pass
                    set_titulo(velev, tname + TIT_EJE.format(gname))
                    log.append('{} {}: {}.'.format(
                        'OK' if not saltar else '  ', tname,
                        label + (' creada' if not saltar else ' ya existia, ajustes reaplicados')))
                except Exception as e:
                    log.append('ERROR {} creando {}: {}'.format(tname, label, e))

            # ---------- 4. aislar las plantas ----------
            # Se hace AL FINAL, cuando las elevaciones ya existen, para poder incluir
            # sus marcadores (categoria Views/Viewers) en el aislamiento: si quedaran
            # fuera, las plantas no mostrarian las marcas de seccion que referencian
            # a las elevaciones.
            marcadores = []
            for g in ejes:
                mk = find_viewer(tname + SUF_EJE + elem_name(g))
                if mk is not None:
                    marcadores.append(mk.Id)
            for v_pl, etiqueta in plantas:
                aislar_assembly(v_pl, ai, ejes, tname, etiqueta, marcadores)

            resumen.append('{}: 1 NIPB + {} T.A. + {} elevacion(es) = {} vista(s).'.format(
                tname, n_ta, len(ejes), 1 + n_ta + len(ejes)))
        except Exception as e:
            log.append('ERROR {}: {}'.format(tname, e))
finally:
    TransactionManager.Instance.TransactionTaskDone()

log.insert(0, 'Assemblies procesados: {} | plantas creadas: {} | elevaciones creadas: {} | saltadas: {}'.format(
    len(targets), plantas_creadas, elevs_creadas, saltadas))
for i, linea in enumerate(resumen):
    log.insert(1 + i, '  ' + linea)
OUT = log
# ----------------------------------------
log = Watch(py_nipb_plantas_t_a_elevaciones)  # graph output
