# Dynamo graph 03_Ejes y cotas entre ejes.dyn (Dynamo 4.0.2.3852)
# Por assembly: enciende los ejes en plantas y elevaciones dejando una sola burbuja por eje, en las elevaciones deja solo los dos ejes extremos recortados al alto del assembly, dibuja el eje de cada viga en las plantas T.A. como linea L-CENTER, y acota entre ejes estructurales y entre ejes de viga.

procesar_todos_los_assemblies = BoolSelector(true)  # graph input
filtro_por_nombre_si_todos_false = StringInput("")  # graph input
cadena_entre_ejes_separacion_al = IntegerSlider(20, range=0..100 step 1)  # "Cadena entre ejes: separacion al borde del assembly (mm)"; graph input
cadena_entre_ejes_horizontal = BoolSelector(true)  # "Cadena entre ejes: horizontal (arriba)"; graph input
cadena_entre_ejes_vertical = BoolSelector(true)  # "Cadena entre ejes: vertical (izquierda)"; graph input
mostrar_ejes_tambien_en_las = BoolSelector(true)  # "Mostrar ejes tambien en las elevaciones"; graph input
eje_de_vigas_dibujar_en_las = BoolSelector(true)  # "Eje de vigas: dibujar en las plantas"; graph input
eje_de_vigas_estilo_de_linea = StringInput("L-CENTER")  # graph input
eje_de_vigas_redibujar_los = BoolSelector(false)  # "Eje de vigas: redibujar los existentes"; graph input
eje_de_vigas_acotar_entre_ejes = BoolSelector(true)  # "Eje de vigas: acotar entre ejes de viga"; graph input
eje_de_vigas_separacion_de_su = IntegerSlider(8, range=2..30 step 1)  # "Eje de vigas: separacion de su cadena a la de ejes (mm)"; graph input
eje_de_vigas_separacion_minima = IntegerSlider(5, range=0..20 step 1)  # "Eje de vigas: separacion minima entre cotas (mm)"; graph input
burbujas_de_eje_solo_arriba_y_a = BoolSelector(true)  # "Burbujas de eje: solo arriba y a la izquierda"; graph input
elevaciones_dejar_solo_los_dos = BoolSelector(true)  # "Elevaciones: dejar solo los dos ejes extremos"; graph input
elevaciones_recortar_la = BoolSelector(true)  # "Elevaciones: recortar la extension de los ejes"; graph input
elevaciones_el_eje_sobresale_por = IntegerSlider(3, range=0..30 step 1)  # "Elevaciones: el eje sobresale por ARRIBA (mm)"; graph input
elevaciones_el_eje_sobresale_por_2 = IntegerSlider(2, range=0..30 step 1)  # "Elevaciones: el eje sobresale por ABAJO (mm)"; graph input
py_ejes_visibles_eje_de_vigas = Python(IN[0]=procesar_todos_los_assemblies, IN[1]=filtro_por_nombre_si_todos_false, IN[2]=cadena_entre_ejes_separacion_al, IN[3]=cadena_entre_ejes_horizontal, IN[4]=cadena_entre_ejes_vertical, IN[5]=mostrar_ejes_tambien_en_las, IN[6]=eje_de_vigas_dibujar_en_las, IN[7]=eje_de_vigas_estilo_de_linea, IN[8]=eje_de_vigas_redibujar_los, IN[9]=eje_de_vigas_acotar_entre_ejes, IN[10]=eje_de_vigas_separacion_de_su, IN[11]=eje_de_vigas_separacion_minima, IN[12]=burbujas_de_eje_solo_arriba_y_a, IN[13]=elevaciones_dejar_solo_los_dos, IN[14]=elevaciones_recortar_la, IN[15]=elevaciones_el_eje_sobresale_por, IN[16]=elevaciones_el_eje_sobresale_por_2)  # "PY | Ejes visibles + eje de vigas + cadenas de cotas"; PythonNet3
# ---------- py_ejes_visibles_eje_de_vigas.python (1198 lines) ----------
# 03_Ejes y cotas entre ejes - ACERO
#
# Reemplaza por completo el 03 de fundaciones (cotas de ancho/largo/altura y spot
# elevations sobre Structural Foundation), que no aplica a estructura metalica.
#
# Hace cuatro cosas:
#   1. Enciende la categoria Grids en las plantas (NIPB y T.A.) y en las elevaciones
#      de eje del assembly, para que los ejes se vean.
#   2. En cada planta T.A. dibuja el EJE de cada viga como una detail line roja con
#      el estilo L-CENTER. En la NIPB no: a esa cota hay placas base, pernos y
#      sillas, no vigas.
#   3. Arma dos familias de cadenas de cotas, nunca por debajo:
#      - entre EJES ESTRUCTURALES: en TODAS las plantas (NIPB y T.A.), horizontal
#        por encima y vertical a la izquierda, por fuera del borde del assembly.
#      - entre EJES DE VIGA: solo en las T.A., por dentro de las anteriores (mas
#        cerca de la planta), horizontal arriba y vertical a AMBOS lados. Las vigas
#        se reparten por mitades - las de la mitad izquierda se acotan a la izquierda
#        y las de la derecha a la derecha - porque una planta de vigas extensa
#        amontona demasiado texto si todo se acota hacia un solo lado.
#   4. En las ELEVACIONES de eje deja solo los dos ejes extremos y les recorta la
#      extension al alto del assembly, con la burbuja arriba. Un eje de por medio
#      no aporta nada en una elevacion (la posicion ya se acota en planta) y en
#      cambio tapa la estructura con lineas verticales.
#
# Entre ejes estructurales se acota eje contra eje (no borde-eje-borde): es lo que
# pide el estandar ("cotas asociadas entre ejes") y evita depender de caras de la
# geometria, que en acero son poco fiables como referencia (pernos, planchas,
# conexiones). La cadena de vigas referencia las propias detail lines L-CENTER que
# dibuja el punto 2, por el mismo motivo.
#
# Revit 2027 / Dynamo 4 / CPython3
# IN[0] = procesar todos los assemblies (bool)
# IN[1] = filtro por nombre si IN[0] es False (parcial, comas)
# IN[2] = separacion de la cadena respecto al borde del assembly, en mm de papel
# IN[3] = cadena horizontal entre ejes, por encima de la planta (bool)
# IN[4] = cadena vertical entre ejes, a la izquierda de la planta (bool)
# IN[5] = mostrar los ejes tambien en las elevaciones de eje (bool)
# IN[6] = dibujar el eje de cada viga en las plantas T.A. (bool)
# IN[7] = nombre del estilo de linea para ese eje (string, ej. L-CENTER)
# IN[8] = redibujar: borra los ejes de viga previos de ese estilo y los rehace (bool)
# IN[9] = acotar entre ejes de viga: arriba y a ambos lados (bool)
# IN[10] = separacion entre la cadena de vigas y la de ejes, en mm de papel
# IN[11] = separacion minima entre dos cotas de la cadena de vigas, en mm de papel
# IN[12] = dejar una sola burbuja por eje: arriba y a la izquierda (bool)
# IN[13] = en las elevaciones, dejar solo los dos ejes extremos (bool)
# IN[14] = en las elevaciones, recortar la extension de los ejes (bool)
# IN[15] = cuanto sobresale el eje POR ENCIMA del assembly, en mm de papel
# IN[16] = cuanto sobresale el eje POR DEBAJO del assembly, en mm de papel

import math
import clr
clr.AddReference('RevitAPI')
clr.AddReference('RevitServices')
from Autodesk.Revit.DB import (FilteredElementCollector, AssemblyInstance, View,
                               Grid, Line, XYZ, Reference, ReferenceArray, Dimension,
                               Element, ElementId, BuiltInCategory, Options,
                               ViewDetailLevel, Solid, GeometryInstance, FamilyInstance,
                               FailureProcessingResult, FailureSeverity,
                               Color, GraphicsStyleType, CurveElement, LinePatternElement,
                               DatumEnds, DatumExtentType)
from System.Collections.Generic import List
from RevitServices.Persistence import DocumentManager
from RevitServices.Transactions import TransactionManager

doc = DocumentManager.Instance.CurrentDBDocument

process_all = bool(IN[0])
filter_text = (IN[1] or '').strip()
offset_mm = float(IN[2])
chain_h = bool(IN[3])
chain_v = bool(IN[4])
ejes_en_elev = bool(IN[5])
dibujar_eje_viga = bool(IN[6])
estilo_pedido = (IN[7] or '').strip() or 'L-CENTER'
redibujar_eje_viga = bool(IN[8])
chain_vigas = bool(IN[9])
sep_cadenas_mm = float(IN[10])
sep_min_cota_mm = float(IN[11])
burbuja_unica = bool(IN[12])
solo_extremos = bool(IN[13])
recortar_ejes_elev = bool(IN[14])
ext_arriba_mm = float(IN[15])
ext_abajo_mm = float(IN[16])

log = []

# --- contrato de nombres con 00_Vistas de assembly ---
SUF_NIPB = ' - NIPB'
SUF_TA = ' - T.A. '
SUF_EJE = ' - EJE '

PARALELO = 0.99
# Revit exige que TODAS las referencias de una cadena sean paralelas ENTRE SI, y una
# sola viga fuera de escuadra hace que rechace la cadena entera al comitear con
# "The References of the highlighted Dimension are no longer parallel".
#
# Su criterio para las cotas es MUCHISIMO mas estricto que Application.AngularTolerance
# (0.1 grados). Medido en ES-1003 / T.A. 01 el 2026-08-03: dos ejes de viga desviados
# 1.45e-4 rad (0.0083 grados) bastaron para que borrara una cadena de 16 referencias.
# Como las vigas bien modeladas coinciden entre si a 1e-15 rad, hay diez ordenes de
# magnitud de margen para cortar; 1e-5 rad son 0.1 mm sobre 10 m.
TOL_PARALELO = 1e-5   # rad, angulo maximo admitido ENTRE DOS referencias de una cadena
TOL_EJE = 0.016    # pies (~5 mm): ejes a menos de esto se consideran el mismo
TOL_LINEA = 0.0033  # pies (~1 mm): por debajo de esto la viga es un punto en planta


def elem_name(e):
    try:
        return e.Name
    except Exception:
        return Element.Name.__get__(e)


def member_solid_bbox(el):
    # bbox a partir de la geometria SOLIDA real (Volume > 0): Element.get_BoundingBox
    # puede devolver un bbox "fantasma" para elementos con geometria degenerada.
    opt = Options()
    opt.DetailLevel = ViewDetailLevel.Fine
    try:
        geo = el.get_Geometry(opt)
    except Exception:
        geo = None
    if geo is None:
        return None
    pts = []

    def puntos(solid, trf):
        sbb = solid.GetBoundingBox()
        for x in (sbb.Min.X, sbb.Max.X):
            for y in (sbb.Min.Y, sbb.Max.Y):
                for z in (sbb.Min.Z, sbb.Max.Z):
                    p = sbb.Transform.OfPoint(XYZ(x, y, z))
                    if trf is not None:
                        p = trf.OfPoint(p)
                    yield p

    for g in geo:
        if isinstance(g, Solid) and g.Volume > 1e-9:
            pts.extend(list(puntos(g, None)))
        elif isinstance(g, GeometryInstance):
            for sg in g.GetSymbolGeometry():
                if isinstance(sg, Solid) and sg.Volume > 1e-9:
                    pts.extend(list(puntos(sg, g.Transform)))
    if not pts:
        return None
    minx = min(p.X for p in pts)
    maxx = max(p.X for p in pts)
    miny = min(p.Y for p in pts)
    maxy = max(p.Y for p in pts)
    minz = min(p.Z for p in pts)
    maxz = max(p.Z for p in pts)

    class _BB(object):
        pass
    r = _BB()
    r.Min = XYZ(minx, miny, minz)
    r.Max = XYZ(maxx, maxy, maxz)
    return r


def miembros_recursivos(ai):
    # todos los elementos del assembly, incluidas las familias anidadas a cualquier
    # profundidad. Se usa para el bbox y para saber que vigas son "de este assembly".
    res = []
    pila = [doc.GetElement(mid) for mid in ai.GetMemberIds()]
    vistos = set()
    while pila:
        el = pila.pop()
        if el is None:
            continue
        try:
            eid = el.Id.Value
        except Exception:
            eid = None
        if eid is not None:
            if eid in vistos:
                continue
            vistos.add(eid)
        res.append(el)
        if isinstance(el, FamilyInstance):
            try:
                for sid in el.GetSubComponentIds():
                    pila.append(doc.GetElement(sid))
            except Exception:
                pass
    return res


def bbox_assembly(miembros):
    # bbox de mundo del assembly a partir de sus miembros recursivos
    pts = []
    for el in miembros:
        bb = member_solid_bbox(el)
        if bb is not None:
            pts.append(bb.Min)
            pts.append(bb.Max)
    if not pts:
        return None

    class _BB(object):
        pass
    r = _BB()
    r.Min = XYZ(min(p.X for p in pts), min(p.Y for p in pts), min(p.Z for p in pts))
    r.Max = XYZ(max(p.X for p in pts), max(p.Y for p in pts), max(p.Z for p in pts))
    return r


def segmento_cruza_rect(p0, p1, xmin, ymin, xmax, ymax):
    # recorte Liang-Barsky del SEGMENTO contra el rectangulo en planta - mismo test
    # que usa 00 para decidir que ejes merecen elevacion, para que ambos graphs
    # trabajen sobre el MISMO conjunto de ejes.
    dx = p1.X - p0.X
    dy = p1.Y - p0.Y
    t0 = 0.0
    t1 = 1.0
    for pc, q in ((-dx, p0.X - xmin), (dx, xmax - p0.X),
                  (-dy, p0.Y - ymin), (dy, ymax - p0.Y)):
        if abs(pc) < 1e-12:
            if q < 0:
                return False
        else:
            r = q / pc
            if pc < 0:
                if r > t1:
                    return False
                if r > t0:
                    t0 = r
            else:
                if r < t0:
                    return False
                if r < t1:
                    t1 = r
    return True


def ejes_que_cruzan(bb, tname):
    res = []
    for g in FilteredElementCollector(doc).OfClass(Grid):
        try:
            c = g.Curve
        except Exception:
            continue
        if c is None or not isinstance(c, Line):
            continue
        if segmento_cruza_rect(c.GetEndPoint(0), c.GetEndPoint(1),
                               bb.Min.X, bb.Min.Y, bb.Max.X, bb.Max.Y):
            res.append(g)
    return res


ID_CAT_GRIDS = ElementId(BuiltInCategory.OST_Grids)
ID_CAT_LINES = ElementId(BuiltInCategory.OST_Lines)


def mostrar_ejes(v, tname, label):
    # enciende la categoria Grids en la vista. En las elevaciones de eje, 00 ya
    # incluyo los ejes en el aislamiento permanente; sin eso, encender la categoria
    # no bastaria porque el elemento quedaria oculto uno por uno.
    try:
        if v.GetCategoryHidden(ID_CAT_GRIDS):
            if v.CanCategoryBeHidden(ID_CAT_GRIDS):
                v.SetCategoryHidden(ID_CAT_GRIDS, False)
                return True
    except Exception as e:
        log.append('AVISO {}: no se pudo encender la categoria Grids en {}: {}'.format(tname, label, e))
    return False


def burbuja_arriba_izquierda(v, grids, tname, label):
    # deja una sola burbuja por eje: la del extremo de ARRIBA en los ejes verticales de
    # la vista y la del extremo IZQUIERDO en los horizontales. ShowBubbleInView y
    # HideBubbleInView son especificos de la vista, asi que las demas vistas del
    # proyecto siguen mostrando las burbujas que ya tenian.
    rd = v.RightDirection
    ud = v.UpDirection
    hechos = 0
    fallidos = 0
    for g in grids:
        try:
            c = g.Curve
            d = c.GetEndPoint(1) - c.GetEndPoint(0)
            du = d.DotProduct(ud)
            dr = d.DotProduct(rd)
            # que extremo se conserva lo decide el eje que MAS separa a los dos: en un
            # eje casi vertical manda la altura, en uno casi horizontal manda el ancho.
            if abs(du) >= abs(dr):
                queda_el_1 = du > 0          # el extremo 1 es el de mas arriba
            else:
                queda_el_1 = dr < 0          # el extremo 1 es el de mas a la izquierda
            buena = DatumEnds.End1 if queda_el_1 else DatumEnds.End0
            mala = DatumEnds.End0 if queda_el_1 else DatumEnds.End1
            g.ShowBubbleInView(buena, v)
            g.HideBubbleInView(mala, v)
            hechos += 1
        except Exception:
            fallidos += 1
    if fallidos:
        log.append('AVISO {}: no se pudo ajustar la burbuja de {} eje(s) en {}.'.format(
            tname, fallidos, label))
    return hechos


# ------------------------------------------------- ejes en las elevaciones

def ejes_visibles_en_elevacion(v, grids):
    # de todos los ejes que cruzan el assembly, los que la elevacion DIBUJA: los
    # perpendiculares al papel, que cortan el plano de la vista en una linea vertical.
    # El eje de la propia elevacion corre a lo largo del papel y Revit no lo dibuja
    # (su plano es paralelo al de la vista), asi que queda fuera solo.
    #
    # Un eje perpendicular tiene todos sus puntos a la misma distancia sobre la
    # horizontal del papel: esa distancia es su posicion en la elevacion.
    rd = v.RightDirection
    res = []
    for g in grids:
        try:
            c = g.Curve
            d = c.GetEndPoint(1) - c.GetEndPoint(0)
            d = XYZ(d.X, d.Y, 0.0)
            if d.GetLength() < 1e-9:
                continue
            if abs(d.Normalize().DotProduct(rd)) > 1.0 - PARALELO:
                continue
            res.append((c.GetEndPoint(0).DotProduct(rd), g))
        except Exception:
            pass
    res.sort(key=lambda it: it[0])
    return res


def corte_con_el_plano_de_vista(g, v):
    # donde la recta del eje atraviesa el plano de la elevacion. La linea que se ve en
    # el papel es la vertical que pasa por ahi, y tiene que estar EN ese plano o Revit
    # rechaza la curva.
    try:
        c = g.Curve
        p = c.GetEndPoint(0)
        d = c.Direction
        vd = v.ViewDirection
        den = d.DotProduct(vd)
        if abs(den) < 1e-9:
            return None
        return p.Add(d.Multiply((v.Origin - p).DotProduct(vd) / den))
    except Exception:
        return None


def recortar_eje_en_elevacion(g, v, z_bajo, z_alto):
    # extension especifica de la vista: el eje deja de cruzar la elevacion de lado a
    # lado y queda del alto del assembly, con la burbuja arriba. La extension 3D del
    # eje (que es global, de toda la planta industrial) no se toca: SetCurveInView
    # con ViewSpecific solo afecta a ESTA vista.
    q = corte_con_el_plano_de_vista(g, v)
    if q is None:
        return False
    linea = Line.CreateBound(XYZ(q.X, q.Y, z_bajo), XYZ(q.X, q.Y, z_alto))
    g.SetDatumExtentType(DatumEnds.End0, v, DatumExtentType.ViewSpecific)
    g.SetDatumExtentType(DatumEnds.End1, v, DatumExtentType.ViewSpecific)
    g.SetCurveInView(DatumExtentType.ViewSpecific, v, linea)
    # cual de los dos extremos quedo arriba se lee de vuelta en vez de darlo por
    # supuesto: si Revit invirtiera la curva, la burbuja iria al pie del eje.
    arriba = DatumEnds.End1
    try:
        curvas = g.GetCurvesInView(DatumExtentType.ViewSpecific, v)
        if curvas is not None and curvas.Count > 0:
            cc = curvas[0]
            if cc.GetEndPoint(0).Z > cc.GetEndPoint(1).Z:
                arriba = DatumEnds.End0
    except Exception:
        pass
    abajo = DatumEnds.End0 if arriba == DatumEnds.End1 else DatumEnds.End1
    g.ShowBubbleInView(arriba, v)
    g.HideBubbleInView(abajo, v)
    return True


def ejes_de_elevacion(v, grids, bb, tname, label):
    # deja la elevacion con los dos ejes de los extremos, recortados al alto del
    # assembly. Devuelve (ocultados, recortados).
    visibles = ejes_visibles_en_elevacion(v, grids)
    if not visibles:
        log.append('AVISO {}: ningun eje se dibuja en {} (todos corren a lo largo de la vista).'.format(
            tname, label))
        return 0, 0

    # primero se recuperan los que oculto una corrida anterior: si el assembly o los
    # ejes cambiaron, los extremos pueden ser otros y los de antes tienen que volver.
    devueltos = []
    for _, g in visibles:
        try:
            if g.IsHidden(v):
                devueltos.append(g.Id)
        except Exception:
            pass
    if devueltos:
        try:
            v.UnhideElements(List[ElementId](devueltos))
        except Exception as e:
            log.append('AVISO {}: no se pudieron recuperar {} eje(s) ocultos en {}: {}'.format(
                tname, len(devueltos), label, e))

    recortados = 0
    if not recortar_ejes_elev:
        # apagar el input tiene que devolver los ejes a su largo real, no dejarlos
        # congelados con el recorte de una corrida anterior.
        for _, g in visibles:
            try:
                g.SetDatumExtentType(DatumEnds.End0, v, DatumExtentType.Model)
                g.SetDatumExtentType(DatumEnds.End1, v, DatumExtentType.Model)
            except Exception:
                pass
    else:
        esc = v.Scale if v.Scale > 0 else 1
        z_alto = bb.Max.Z + ext_arriba_mm / 304.8 * esc
        z_bajo = bb.Min.Z - ext_abajo_mm / 304.8 * esc
        fallidos = 0
        ultimo = None
        for _, g in visibles:
            try:
                if recortar_eje_en_elevacion(g, v, z_bajo, z_alto):
                    recortados += 1
            except Exception as e:
                fallidos += 1
                ultimo = e
        if fallidos:
            log.append('AVISO {}: no se pudo recortar {} eje(s) en {}: {}'.format(
                tname, fallidos, label, ultimo))

    ocultados = 0
    if solo_extremos and len(visibles) > 2:
        # la posicion de los ejes de por medio ya esta acotada en las plantas; aqui
        # solo sirven los dos extremos, como referencia del ancho de la estructura.
        sobran = [g.Id for _, g in visibles[1:-1]]
        try:
            v.HideElements(List[ElementId](sobran))
            ocultados = len(sobran)
        except Exception as e:
            log.append('AVISO {}: no se pudieron ocultar los ejes intermedios de {}: {}'.format(
                tname, label, e))
    if ocultados or recortados:
        log.append('OK {}: {} - {} eje(s) visibles, {} recortado(s), {} oculto(s); quedan {}.'.format(
            tname, label, len(visibles), recortados, ocultados,
            ', '.join(elem_name(g) for _, g in
                      ([visibles[0], visibles[-1]] if ocultados else visibles))))
    return ocultados, recortados


# ------------------------------------------------- eje de vigas en planta

_estilo_cache = {}


def patron_de_eje():
    # patron de linea de eje ya cargado en el proyecto; si no hay ninguno, solida.
    for lp in FilteredElementCollector(doc).OfClass(LinePatternElement):
        try:
            n = elem_name(lp).lower()
        except Exception:
            continue
        if 'center' in n or 'centro' in n or n.startswith('eje'):
            return lp.Id
    return None


def estilo_linea(nombre):
    # GraphicsStyle de la subcategoria de Lines con ese nombre. Si no existe se crea
    # roja y con patron de eje, para que el graph tambien funcione en un modelo que
    # todavia no tiene cargado el estandar. Si ya existe NO se toca: el grafismo de
    # L-CENTER es del proyecto, no de este script.
    if nombre in _estilo_cache:
        return _estilo_cache[nombre]
    gs = None
    try:
        cat = doc.Settings.Categories.get_Item(BuiltInCategory.OST_Lines)
        sub = None
        for c in cat.SubCategories:
            if c.Name.strip().lower() == nombre.strip().lower():
                sub = c
                break
        if sub is None:
            sub = doc.Settings.Categories.NewSubcategory(cat, nombre)
            sub.LineColor = Color(255, 0, 0)
            pid = patron_de_eje()
            if pid is not None:
                sub.SetLinePatternId(pid, GraphicsStyleType.Projection)
            doc.Regenerate()
            log.append('Estilo de linea "{}": no existia, se creo rojo{}.'.format(
                nombre, '' if pid is None else ' con patron de eje'))
        else:
            try:
                col = sub.LineColor
                log.append('Estilo de linea "{}": ya existe, RGB {},{},{} (se usa tal cual).'.format(
                    nombre, col.Red, col.Green, col.Blue))
            except Exception:
                log.append('Estilo de linea "{}": ya existe (se usa tal cual).'.format(nombre))
        gs = sub.GetGraphicsStyle(GraphicsStyleType.Projection)
        if gs is None:
            log.append('ERROR: el estilo de linea "{}" no tiene GraphicsStyle de proyeccion.'.format(nombre))
    except Exception as e:
        log.append('ERROR: no se pudo resolver el estilo de linea "{}": {}'.format(nombre, e))
    _estilo_cache[nombre] = gs
    return gs


def planos_candidatos(view):
    # cotas donde puede vivir una detail line de esta planta. Una planta es
    # horizontal, asi que "proyectar al plano de la vista" es fijar la Z. Lo normal
    # es view.Origin.Z; el nivel de la vista es el plan B por si Origin no cayera en
    # el plano de trabajo (Revit rechaza la curva: "must be in the plane of the view").
    zs = [view.Origin.Z]
    try:
        lv = view.GenLevel
        if lv is not None and abs(lv.ProjectElevation - zs[0]) > 1e-9:
            zs.append(lv.ProjectElevation)
    except Exception:
        pass
    return zs


def lineas_previas(view, gs_id):
    prev = []
    for e in (FilteredElementCollector(doc, view.Id)
              .OfCategory(BuiltInCategory.OST_Lines)
              .WhereElementIsNotElementType()):
        try:
            if isinstance(e, CurveElement) and e.LineStyle is not None and e.LineStyle.Id == gs_id:
                prev.append(e.Id)
        except Exception:
            pass
    return prev


def ejes_de_viga(view, gs, ids_miembros, tname, label):
    # dibuja el eje (curva de ubicacion) de cada viga VISIBLE en la planta, como
    # detail line: es especifica de la vista, asi que cada planta muestra solo los
    # ejes de las vigas de SU nivel y el modelo no se ensucia con lineas de modelo.
    # Devuelve (lineas de la vista, cuantas se crearon ahora). Las lineas se devuelven
    # tambien cuando ya existian, porque son las referencias de la cadena de vigas.
    if gs is None:
        return [], 0
    prev = lineas_previas(view, gs.Id)
    if prev:
        if not redibujar_eje_viga:
            log.append('{}: {} ya tiene {} linea(s) de eje de viga, se salta el dibujo.'.format(
                tname, label, len(prev)))
            return [doc.GetElement(i) for i in prev], 0
        try:
            doc.Delete(List[ElementId](prev))
        except Exception as e:
            log.append('AVISO {}: no se pudieron borrar los ejes previos de {}: {}'.format(tname, label, e))
    try:
        # el colector por vista respeta el View Range y el aislamiento, asi que
        # devuelve exactamente las vigas del nivel que esa planta documenta.
        vigas = [e for e in (FilteredElementCollector(doc, view.Id)
                             .OfCategory(BuiltInCategory.OST_StructuralFraming)
                             .WhereElementIsNotElementType())
                 if e.Id.Value in ids_miembros]
    except Exception as e:
        log.append('ERROR {}: no se pudieron listar las vigas de {}: {}'.format(tname, label, e))
        return [], 0
    if not vigas:
        log.append('{}: {} no muestra vigas del assembly; sin ejes que dibujar.'.format(tname, label))
        return [], 0
    # las detail lines viven en la categoria Lines: si el template la apaga, no se ven
    try:
        if view.GetCategoryHidden(ID_CAT_LINES) and view.CanCategoryBeHidden(ID_CAT_LINES):
            view.SetCategoryHidden(ID_CAT_LINES, False)
    except Exception as e:
        log.append('AVISO {}: no se pudo encender la categoria Lines en {}: {}'.format(tname, label, e))
    zs = planos_candidatos(view)
    z_ok = zs[0]
    z_fijo = False       # en cuanto una detail line entra, esa cota es LA cota
    ultimo_error = None
    dibujadas = []
    hechas = 0
    sin_curva = 0
    verticales = 0
    fallidas = 0
    for el in vigas:
        c = None
        try:
            loc = el.Location
            if loc is not None and hasattr(loc, 'Curve'):
                c = loc.Curve
        except Exception:
            c = None
        if c is None:
            sin_curva += 1
            continue
        try:
            if isinstance(c, Line):
                pts = [c.GetEndPoint(0), c.GetEndPoint(1)]
            else:
                pts = list(c.Tessellate())   # viga curva: poligonal en planta
        except Exception:
            sin_curva += 1
            continue
        # aplanados a Z=0 solo para medir el largo EN PLANTA (la Z real la pone el
        # plano de la vista, mas abajo)
        pares = [(XYZ(a.X, a.Y, 0.0), XYZ(b.X, b.Y, 0.0)) for a, b in zip(pts[:-1], pts[1:])]
        segs = [(a, b) for a, b in pares if a.DistanceTo(b) >= TOL_LINEA]
        if not segs:
            verticales += 1   # riostra o pilarcillo vertical: en planta el eje es un punto
            continue
        for a, b in segs:
            hecha = False
            for z in ([z_ok] if z_fijo else zs):
                try:
                    dc = doc.Create.NewDetailCurve(
                        view, Line.CreateBound(XYZ(a.X, a.Y, z), XYZ(b.X, b.Y, z)))
                    dc.LineStyle = gs
                    dibujadas.append(dc)
                    hechas += 1
                    hecha = True
                    if not z_fijo:
                        if z != zs[0]:
                            log.append('AVISO {}: en {} las detail lines van a EL. {:.3f} pies; view.Origin no servia.'.format(
                                tname, label, z))
                        z_ok = z
                        z_fijo = True
                    break
                except Exception as e:
                    ultimo_error = e
            if not hecha:
                fallidas += 1
                if fallidas == 1:
                    log.append('ERROR {}: no se pudo dibujar el eje de una viga en {}: {}'.format(
                        tname, label, ultimo_error))
    detalles = []
    if sin_curva:
        detalles.append('{} sin curva de ubicacion'.format(sin_curva))
    if verticales:
        detalles.append('{} verticales'.format(verticales))
    if fallidas:
        detalles.append('{} fallidas'.format(fallidas))
    log.append('OK {}: {} linea(s) de eje en {} sobre {} viga(s){}.'.format(
        tname, hechas, label, len(vigas),
        '' if not detalles else ' [' + ', '.join(detalles) + ']'))
    return dibujadas, hechas


def cadenas_existentes(v, gs):
    # que cadenas ya dibujo este graph en la vista, mirando A QUE referencia la primera
    # cota de cada cadena: un Grid es la cadena entre ejes, una detail line del estilo
    # pedido es la cadena entre ejes de viga. Asi se puede agregar la cadena de vigas a
    # una planta que ya tenia la de ejes, sin rehacer ni duplicar esa.
    res = set()
    gs_id = gs.Id if gs is not None else None
    for dim in FilteredElementCollector(doc, v.Id).OfClass(Dimension):
        try:
            primera = None
            for ref in dim.References:
                primera = ref
                break
            if primera is None:
                continue
            el = doc.GetElement(primera.ElementId)
            if el is None:
                continue
            if isinstance(el, Grid):
                res.add('ejes')
            elif (gs_id is not None and isinstance(el, CurveElement)
                  and el.LineStyle is not None and el.LineStyle.Id == gs_id):
                res.add('vigas')
        except Exception:
            pass
    return res


def orientar(e, hacia):
    # sentido canonico de una direccion: la que apunte hacia el mismo lado que "hacia"
    return e if e.DotProduct(hacia) >= 0 else e.Negate()


def perp_en_plano(e, hacia):
    # perpendicular en planta, orientada hacia donde se pide
    return orientar(XYZ(-e.Y, e.X, 0.0), hacia)


def extremos_bbox(bb, eje):
    # proyeccion minima y maxima del bbox del assembly sobre un eje cualquiera
    vals = []
    for x in (bb.Min.X, bb.Max.X):
        for y in (bb.Min.Y, bb.Max.Y):
            for z in (bb.Min.Z, bb.Max.Z):
                vals.append(XYZ(x, y, z).DotProduct(eje))
    return min(vals), max(vals)


def desvio(d, dom):
    # seno del angulo entre dos direcciones unitarias en planta. Se usa el producto
    # CRUZ y no el escalar: cerca del paralelismo el coseno pierde toda la precision
    # (cos(1e-5) y 1.0 son el mismo double), mientras que el seno vale el angulo.
    return abs(d.X * dom.Y - d.Y * dom.X)


def direccion_dominante(dcs):
    # la direccion que acumula MAS METROS de linea, no la que tienen mas piezas: es el
    # mismo criterio con el que 00 elige el nivel dominante de una planta T.A., y por el
    # mismo motivo - un par de piezas cortas fuera de escuadra no puede decidir por el
    # grupo entero. Las cubetas son tan finas como la tolerancia de paralelismo, para
    # que una viga apenas torcida caiga en OTRA cubeta y no contamine la dominante.
    cubetas = {}
    for dc in dcs:
        try:
            c = dc.GeometryCurve
            d = orientar(c.Direction, XYZ(1.0, 0.0, 0.0))
            if abs(d.X) < 1e-9 and d.Y < 0:
                d = d.Negate()
            k = int(round(math.atan2(d.Y, d.X) / TOL_PARALELO))
            acc = cubetas.get(k)
            if acc is None:
                cubetas[k] = [c.Length, d]
            else:
                acc[0] += c.Length
        except Exception:
            pass
    if not cubetas:
        return None
    return max(cubetas.values(), key=lambda a: a[0])[1]


def alinear_grupo(dcs, hacia):
    # deja solo las lineas paralelas a la direccion dominante. Lo que sobra son
    # diagonales reales (arriostramientos) o vigas mal modeladas: si entraran, Revit
    # rechazaria la cadena COMPLETA.
    #
    # El corte es a TOL_PARALELO/2 y no a TOL_PARALELO a proposito: la condicion que le
    # importa a Revit es entre CADA PAR de referencias, no contra un promedio. Dos vigas
    # desviadas +tol y -tol respecto de la dominante pasarian las dos y estarian 2*tol
    # una de otra. Con medio umbral, cualquier par queda dentro de TOL_PARALELO.
    dom = direccion_dominante(dcs)
    if dom is None:
        return None, [], 0, 0.0
    dom = orientar(dom, hacia)
    ok = []
    fuera = 0
    peor = 0.0
    for dc in dcs:
        try:
            s = desvio(dc.GeometryCurve.Direction, dom)
            if s <= TOL_PARALELO / 2.0:
                ok.append(dc)
            else:
                fuera += 1
                if s > peor:
                    peor = s
        except Exception:
            fuera += 1
    return dom, ok, fuera, peor


def dibujar_cadena(view, items, eje_medida, eje_perp, valor_perp, tname, etiqueta,
                   sep_min=TOL_EJE):
    # items = [(posicion a lo largo de eje_medida, Reference, nombre)]. La linea de cota
    # corre a lo largo de eje_medida y se dibuja a "valor_perp" sobre eje_perp, ya
    # desplazado por fuera del borde del assembly. Los dos ejes son unitarios,
    # perpendiculares entre si y horizontales, asi que generan el plano de la planta.
    if len(items) < 2:
        log.append('AVISO {}: menos de 2 referencias para la cadena {}; no se acota.'.format(
            tname, etiqueta))
        return 0
    items.sort(key=lambda it: it[0])
    filtrados = []
    ultimo = None
    for pos, ref, nombre in items:
        if ultimo is None or pos - ultimo > sep_min:
            filtrados.append((pos, ref, nombre))
            ultimo = pos
    fusionadas = len(items) - len(filtrados)
    if len(filtrados) < 2:
        log.append('AVISO {}: las referencias de la cadena {} estan superpuestas; no se acota.'.format(
            tname, etiqueta))
        return 0
    ra = ReferenceArray()
    for pos, ref, nombre in filtrados:
        ra.Append(ref)
    z = view.Origin.Z
    desp = eje_perp.Multiply(valor_perp)
    a = eje_medida.Multiply(filtrados[0][0]).Add(desp)
    b = eje_medida.Multiply(filtrados[-1][0]).Add(desp)
    p1 = XYZ(a.X, a.Y, z)
    p2 = XYZ(b.X, b.Y, z)
    if p1.DistanceTo(p2) < 1e-6:
        log.append('AVISO {}: la cadena {} quedaria de largo cero.'.format(tname, etiqueta))
        return 0
    dim = doc.Create.NewDimension(view, Line.CreateBound(p1, p2), ra)
    creadas.append((tname, etiqueta, dim.Id))
    nombres = [n for _, _, n in filtrados if n]
    menor = min(filtrados[i + 1][0] - filtrados[i][0] for i in range(len(filtrados) - 1))
    log.append('OK {}: cadena {} con {} referencias, largo {:.2f} m, menor segmento {:.0f} mm{}{}.'.format(
        tname, etiqueta, len(filtrados), p1.DistanceTo(p2) * 0.3048, menor * 304.8,
        ', {} fusionadas por cercania'.format(fusionadas) if fusionadas else '',
        ' ({})'.format(', '.join(nombres)) if nombres else ''))
    return 1


def items_de_ejes(grids, d_medida):
    items = []
    for g in grids:
        try:
            ref = Reference(g)
        except Exception:
            continue
        items.append((g.Curve.Evaluate(0.5, True).DotProduct(d_medida), ref, elem_name(g)))
    return items


def items_de_vigas(dcs, d_medida):
    # se acota contra las propias detail lines L-CENTER: son EL eje de la viga, estan
    # en la misma vista y son referencias limpias, a diferencia de las caras del acero.
    items = []
    for dc in dcs:
        try:
            c = dc.GeometryCurve
            ref = c.Reference
            if ref is None:
                continue
            items.append((c.Evaluate(0.5, True).DotProduct(d_medida), ref, ''))
        except Exception:
            pass
    return items


# ------------------------------------------------------------------ main

by_type = {}
for ai in FilteredElementCollector(doc).OfClass(AssemblyInstance):
    by_type.setdefault(ai.AssemblyTypeName, []).append(ai)

if not by_type:
    log.append('AVISO: no hay ningun Assembly en el modelo; nada que anotar.')

if process_all:
    targets = sorted(by_type.keys())
else:
    tokens = [t.strip().lower() for t in filter_text.split(',') if t.strip()]
    if tokens:
        targets = [n for n in sorted(by_type.keys())
                   if any(tok in n.lower() for tok in tokens)]
    else:
        targets = []
        log.append('ERROR: "Todos" esta en False y el filtro esta vacio.')

views = {}
for v in FilteredElementCollector(doc).OfClass(View):
    if not v.IsTemplate:
        views[elem_name(v)] = v

total = 0
encendidas = 0
burbujas = 0
lineas_eje = 0
ocultos_elev = 0
recortes_elev = 0
creadas = []      # (assembly, etiqueta, id) de cada cadena, para verificar tras el commit
ids_lineas = []   # idem para los ejes de viga


fallas = {}   # descripcion de Revit -> [cantidad, ids de ejemplo]


def _resolver_fallas(sender, args):
    # al confirmar la transaccion, elimina automaticamente las cotas que Revit
    # rechaza por referencias invalidas, en vez de mostrar el dialogo bloqueante.
    # ANTES el mensaje de Revit se descartaba sin leerlo, y era justo el dato que
    # hacia falta para saber por que rechazaba una cadena: ahora se acumula y se
    # vuelca al log despues del commit.
    try:
        fa = args.GetFailuresAccessor()
        resultado = FailureProcessingResult.Continue
        for f in fa.GetFailureMessages():
            try:
                try:
                    desc = f.GetDescriptionText()
                except Exception:
                    desc = '(sin descripcion)'
                es_aviso = f.GetSeverity() == FailureSeverity.Warning
                ids = []
                try:
                    ids = [i.Value for i in f.GetFailingElementIds()]
                except Exception:
                    pass
                clave = '{}: {}'.format('AVISO' if es_aviso else 'ERROR', desc)
                acc = fallas.get(clave)
                if acc is None:
                    fallas[clave] = [1, ids[:8]]
                else:
                    acc[0] += 1
                    if len(acc[1]) < 8:
                        acc[1].extend(ids[:8 - len(acc[1])])
                if es_aviso:
                    fa.DeleteWarning(f)
                    continue
                if ids:
                    fa.DeleteElements(List[ElementId](f.GetFailingElementIds()))
                    resultado = FailureProcessingResult.ProceedWithCommit
                elif f.HasResolutions():
                    fa.ResolveFailure(f)
                    resultado = FailureProcessingResult.ProceedWithCommit
            except Exception:
                pass
        args.SetProcessingResult(resultado)
    except Exception:
        pass


app = doc.Application
app.FailuresProcessing += _resolver_fallas
TransactionManager.Instance.EnsureInTransaction(doc)
try:
    gs_eje = estilo_linea(estilo_pedido) if ((dibujar_eje_viga or chain_vigas) and targets) else None
    for tname in targets:
        ai = by_type[tname][0]
        try:
            miembros = miembros_recursivos(ai)
            ids_miembros = set()
            for el in miembros:
                try:
                    ids_miembros.add(el.Id.Value)
                except Exception:
                    pass
            bb = bbox_assembly(miembros)
            if bb is None:
                log.append('ERROR {}: sin geometria solida valida; se omite.'.format(tname))
                continue
            ejes = ejes_que_cruzan(bb, tname)

            # el tercer elemento marca la NIPB: no lleva eje de vigas ni su cadena
            plantas = []
            v = views.get(tname + SUF_NIPB)
            if v is not None:
                plantas.append((v, 'planta NIPB', True))
            for n in sorted(k for k in views if k.startswith(tname + SUF_TA)):
                plantas.append((views[n], n[len(tname) + 3:], False))
            elevaciones = [(views[n], n[len(tname) + 3:])
                           for n in sorted(k for k in views if k.startswith(tname + SUF_EJE))]

            if not plantas:
                log.append('AVISO {}: no existen las plantas (corre 00_Vistas de assembly).'.format(tname))
                continue

            # --- 1. ejes visibles, con una sola burbuja por eje ---
            for v, label, _ in plantas:
                if mostrar_ejes(v, tname, label):
                    encendidas += 1
                if burbuja_unica and ejes:
                    burbujas += burbuja_arriba_izquierda(v, ejes, tname, label)
            if ejes_en_elev:
                for v, label in elevaciones:
                    if mostrar_ejes(v, tname, label):
                        encendidas += 1
                    if ejes:
                        try:
                            o, r = ejes_de_elevacion(v, ejes, bb, tname, label)
                            ocultos_elev += o
                            recortes_elev += r
                        except Exception as e:
                            log.append('ERROR {} ejes de la elevacion {}: {}'.format(tname, label, e))

            if not ejes:
                log.append('AVISO {}: ningun eje cruza el assembly; no hay cadena entre ejes.'.format(tname))

            # --- 2. por cada planta: eje de las vigas y cadenas de cotas ---
            for v, label, es_nipb in plantas:
                rd = v.RightDirection
                ud = v.UpDirection
                esc = v.Scale if v.Scale > 0 else 1
                off = offset_mm / 304.8 * esc
                # la cadena de vigas va por DENTRO de la de ejes, mas cerca de la planta
                off_viga = off - sep_cadenas_mm / 304.8 * esc
                if off_viga <= 0:
                    off_viga = off / 2.0
                    log.append('AVISO {}: la separacion entre cadenas es mayor que la separacion al borde; la cadena de vigas de {} se pone a media distancia.'.format(
                        tname, label))

                # extension del assembly proyectada sobre los ejes de la vista
                rs = []
                us = []
                for x in (bb.Min.X, bb.Max.X):
                    for y in (bb.Min.Y, bb.Max.Y):
                        for z in (bb.Min.Z, bb.Max.Z):
                            p = XYZ(x, y, z)
                            rs.append(p.DotProduct(rd))
                            us.append(p.DotProduct(ud))
                r0, r1 = min(rs), max(rs)
                u0, u1 = min(us), max(us)

                # --- 2a. eje de cada viga como detail line (solo en las T.A.) ---
                dcs = []
                if es_nipb:
                    # a la cota de la NIPB hay placas base, pernos y sillas, no vigas:
                    # ahi el eje de viga no dice nada. Si una corrida anterior lo dibujo
                    # se limpia, y Revit se lleva de paso la cadena que lo referenciaba.
                    if gs_eje is not None:
                        prev = lineas_previas(v, gs_eje.Id)
                        if prev:
                            try:
                                doc.Delete(List[ElementId](prev))
                                doc.Regenerate()
                                log.append('{}: {} - borrados {} eje(s) de viga y su cadena; las NIPB no los llevan.'.format(
                                    tname, label, len(prev)))
                            except Exception as e:
                                log.append('AVISO {}: no se pudieron borrar los ejes de viga de {}: {}'.format(
                                    tname, label, e))
                elif dibujar_eje_viga:
                    try:
                        dcs, nuevas = ejes_de_viga(v, gs_eje, ids_miembros, tname, label)
                        lineas_eje += nuevas
                        for dc in dcs:
                            try:
                                ids_lineas.append(dc.Id)
                            except Exception:
                                pass
                    except Exception as e:
                        log.append('ERROR {} eje de vigas en {}: {}'.format(tname, label, e))
                elif chain_vigas and gs_eje is not None:
                    # sin dibujar nada: se acota contra los ejes que ya estuvieran
                    dcs = [doc.GetElement(i) for i in lineas_previas(v, gs_eje.Id)]
                if dcs:
                    # sin regenerar, GeometryCurve.Reference de una linea recien creada
                    # puede venir nula y la cadena de vigas se quedaria sin referencias
                    doc.Regenerate()

                # que cadenas hay YA en la vista. Se mira despues de 2a a proposito: si
                # se redibujaron los ejes, Revit se llevo por delante la cadena de vigas
                # que los referenciaba, y aqui tiene que constar que ya no esta.
                ya = cadenas_existentes(v, gs_eje)

                # --- 2b. cadena entre ejes estructurales, por fuera ---
                if ejes:
                    # un eje paralelo a "arriba" de la vista se mide a lo largo de
                    # "derecha", y su cadena va por encima del assembly; y viceversa.
                    g_para_h = []
                    g_para_v = []
                    oblicuos = []
                    for g in ejes:
                        c = g.Curve
                        d = c.GetEndPoint(1) - c.GetEndPoint(0)
                        d = XYZ(d.X, d.Y, 0.0)
                        if d.GetLength() < 1e-9:
                            continue
                        d = d.Normalize()
                        if abs(d.DotProduct(ud)) > PARALELO:
                            g_para_h.append(g)
                        elif abs(d.DotProduct(rd)) > PARALELO:
                            g_para_v.append(g)
                        else:
                            oblicuos.append(elem_name(g))
                    log.append('DIAG {} / {}: ejes para la cadena de arriba: {} | para la de la izquierda: {} | oblicuos: {}'.format(
                        tname, label, len(g_para_h), len(g_para_v), len(oblicuos)))
                    if oblicuos:
                        log.append('AVISO {}: ejes oblicuos a la vista, fuera de la cadena: {}.'.format(
                            tname, ', '.join(sorted(oblicuos))))

                    if 'ejes' in ya:
                        log.append('{}: {} ya tiene cadena entre ejes, se salta.'.format(tname, label))
                    else:
                        if chain_h:
                            try:
                                total += dibujar_cadena(v, items_de_ejes(g_para_h, rd), rd, ud, u1 + off,
                                                        tname, '{} ejes arriba'.format(label))
                            except Exception as e:
                                log.append('ERROR {} cadena de ejes horizontal en {}: {}'.format(tname, label, e))
                        if chain_v:
                            try:
                                total += dibujar_cadena(v, items_de_ejes(g_para_v, ud), ud, rd, r0 - off,
                                                        tname, '{} ejes izquierda'.format(label))
                            except Exception as e:
                                log.append('ERROR {} cadena de ejes vertical en {}: {}'.format(tname, label, e))

                # --- 2c. cadena entre ejes de viga, por dentro (solo en las T.A.) ---
                if es_nipb or not chain_vigas or not dcs:
                    continue
                # Primer reparto grueso: cada eje de viga va al grupo del eje de la vista
                # al que MAS se parece, sin umbral. El filtro fino lo hace despues
                # alinear_grupo() contra la direccion dominante, que es el criterio que
                # de verdad le importa a Revit.
                g_arriba = []
                g_lados = []
                for dc in dcs:
                    try:
                        d = dc.GeometryCurve.Direction
                        if abs(d.DotProduct(ud)) >= abs(d.DotProduct(rd)):
                            g_arriba.append(dc)
                        else:
                            g_lados.append(dc)
                    except Exception:
                        pass
                dom_h, dcs_h, fuera_h, peor_h = alinear_grupo(g_arriba, ud)
                dom_v, dcs_v, fuera_v, peor_v = alinear_grupo(g_lados, rd)

                # las vigas de la mitad izquierda se acotan a la izquierda y las de la
                # derecha a la derecha: una planta extensa acotada a un solo lado
                # amontona demasiadas cotas para poder leerlas.
                dcs_izq = []
                dcs_der = []
                lo_v = hi_v = 0.0
                if dom_v is not None:
                    lo_v, hi_v = extremos_bbox(bb, dom_v)
                    centro_v = (lo_v + hi_v) / 2.0
                    for dc in dcs_v:
                        try:
                            if dc.GeometryCurve.Evaluate(0.5, True).DotProduct(dom_v) <= centro_v:
                                dcs_izq.append(dc)
                            else:
                                dcs_der.append(dc)
                        except Exception:
                            pass

                log.append('DIAG {} / {}: ejes de viga -> arriba: {} | izquierda: {} | derecha: {} | no paralelos: {} | total dibujados: {}'.format(
                    tname, label, len(dcs_h), len(dcs_izq), len(dcs_der),
                    fuera_h + fuera_v, len(dcs)))
                if fuera_h + fuera_v:
                    peor = max(peor_h, peor_v)
                    log.append('AVISO {}: {} eje(s) de viga no paralelos a la direccion dominante en {}, fuera de la cadena (desvio maximo {:.4f} grados).'.format(
                        tname, fuera_h + fuera_v, label,
                        math.degrees(math.asin(min(1.0, peor)))))
                if 'vigas' in ya:
                    log.append('{}: {} ya tiene cadena entre ejes de viga, se salta.'.format(tname, label))
                    continue

                cadenas_viga = []
                if dom_h is not None and dcs_h:
                    lo_h, hi_h = extremos_bbox(bb, dom_h)
                    cadenas_viga.append((dcs_h, perp_en_plano(dom_h, rd), dom_h,
                                         hi_h + off_viga, 'arriba'))
                if dom_v is not None:
                    m_v = perp_en_plano(dom_v, ud)
                    if dcs_izq:
                        cadenas_viga.append((dcs_izq, m_v, dom_v, lo_v - off_viga, 'izquierda'))
                    if dcs_der:
                        cadenas_viga.append((dcs_der, m_v, dom_v, hi_v + off_viga, 'derecha'))

                # dos ejes de viga a menos de esto en el papel dan cotas encimadas e
                # ilegibles; se fusionan en una sola referencia y la cota pasa a medir el
                # salto completo. Es tambien lo que evita segmentos de milimetros, que son
                # los que hacen que Revit rechace la cadena entera al comitear.
                sep_min = max(TOL_EJE, sep_min_cota_mm / 304.8 * esc)
                for dcl, eje_med, eje_perp, perp, lado in cadenas_viga:
                    try:
                        total += dibujar_cadena(v, items_de_vigas(dcl, eje_med), eje_med, eje_perp,
                                                perp, tname, '{} vigas {}'.format(label, lado),
                                                sep_min)
                    except Exception as e:
                        log.append('ERROR {} cadena de vigas {} en {}: {}'.format(tname, lado, label, e))
        except Exception as e:
            log.append('ERROR {}: {}'.format(tname, e))
finally:
    try:
        TransactionManager.Instance.TransactionTaskDone()
        # Dynamo confirma su transaccion al final del run, cuando este script ya
        # termino y el manejador de fallas se des-suscribio. Forzamos el commit
        # AQUI para que el manejador intercepte las referencias invalidas.
        TransactionManager.Instance.ForceCloseTransaction()
    finally:
        app.FailuresProcessing -= _resolver_fallas

# verificar cuales cadenas sobrevivieron al commit
descartadas = []
for tname_c, etiqueta_c, did in creadas:
    try:
        if doc.GetElement(did) is None:
            descartadas.append('{} ({}, id {})'.format(tname_c, etiqueta_c, did.Value))
    except Exception:
        pass
if descartadas:
    total -= len(descartadas)
    log.append('AVISO: cadenas eliminadas por referencias invalidas: ' + ', '.join(descartadas))
    log.append('Causa habitual: el eje no es visible en esa vista (Revit no acota lo que no ve).')
    log.append('Revisa que la categoria Grids este encendida y que el eje entre en el crop de la vista.')
    log.append('Si la cadena es de vigas, sube "separacion minima entre cotas": los segmentos de')
    log.append('pocos milimetros tambien hacen que Revit rechace la cadena completa.')

# idem para los ejes de viga: si el handler de fallas se llevo alguno, hay que saberlo
perdidas = 0
for lid in ids_lineas:
    try:
        if doc.GetElement(lid) is None:
            perdidas += 1
    except Exception:
        pass
if perdidas:
    log.append('AVISO: {} linea(s) de eje de viga eliminadas al comitear.'.format(perdidas))

# lo que Revit dijo textualmente al comitear: es el unico dato que explica por que
# rechaza una cadena, y hasta ahora se estaba descartando sin leerlo
if fallas:
    log.append('--- mensajes de Revit al comitear ---')
    for clave in sorted(fallas.keys()):
        n, ejemplo = fallas[clave]
        log.append('{} (x{}){}'.format(
            clave, n,
            ' | elementos: ' + ', '.join(str(i) for i in ejemplo) if ejemplo else ''))

log.insert(0, 'Cadenas creadas: {} | lineas de eje de viga: {} | burbujas ajustadas: {} | ejes recortados en elevaciones: {} | ejes ocultos en elevaciones: {} | vistas con Grids encendido: {} | assemblies procesados: {}'.format(
    total, lineas_eje, burbujas, recortes_elev, ocultos_elev, encendidas, len(targets)))
OUT = log
# ----------------------------------------
log = Watch(py_ejes_visibles_eje_de_vigas)  # graph output
